# Grasshopper definition Terraced_house.gh (Grasshopper 1.0.7)
# plug-ins: CORE.Toolbox.Grasshopper, MetaHopper, CORE.Grasshopper.Colibri, Hops, Human, PollinationGH

# ---- group: Uh | Group color manager
# Group layers
# Geometry Category Tag {Geo}
# Group components related to geometry
# creation, manipulation, and
# transformations.
# Geometery Category --> Sub_group_1 Tag {Geo_1}
# Geometery Category --> Sub_group_2 Tag {Geo_2}
# Inputs Category Tag {Inp}
# Group components that serve as input parameters.
# These might include sliders, number inputs, text inputs, and
# any other user-defined variables
# Input Category --> Sub_group_1 Tag {Inp_1}
# Input Category --> Sub_group_2 Tag {Inp_2}
# Output Category Tag {Out}
# Group components that generate
# the final output such as
# geometry previews, or data outputs.
# Out Category --> Sub_group_1 Tag {Out_1}
# Out Category --> Sub_group_2 Tag {Out_2}
groups = GetGroups()  # -> Groups, GroupStyles, Nickname, Color
category_tag = Panel("""Scr
Bol
Geo
Geo_1
Geo_2
Inp
Inp_1
Inp_2
Lbhb
Lbhb_1
Lbhb_2
Uh
Uh_1
Uh_2
Viz
Viz_1
Viz_2
Ie
Ie_1
Ie_2
Out
Out_1
Out_2
Samp
Samp_1
Samp_2""")
python = GhPythonScript(list_string=groups.Nickname, expression=graft(category_tag))  # -> out, group_names
# ---------- python: Python ----------
__author__ = "prateekwahi"
__version__ = "2023.08.17"

import rhinoscriptsyntax as rs

def match(input_1, input_2):
    if input_2 in input_1:
        return input_1

group_names = match(list_string, expression)
print(group_names)
# ---------- end python ----------
# Ladybug/Honeybee Category Tag {Lbhb}
# Group components for environmental analysis,
# simulation, and data visualization using
# Ladybug and Honeybee.
list_of_colors = Panel("""255,255,255,150
255,0,128,150
179, 230, 170, 150
102, 204, 102, 150
0, 153, 0, 150
178, 204, 255, 150
102, 151, 204, 150
0, 102, 204, 150
255, 230, 153, 150
255, 204,102, 150
255, 153, 0, 150
212, 212, 212, 150
192, 192, 192, 150
128, 128, 128, 150
191, 163, 255, 150
149, 117, 205, 150
105, 59, 184, 150
169, 195, 204, 150
139, 178, 195, 150
97, 126, 140, 150
253,153,153,150
255,102,102,150
204,0,0,150
166, 230, 191, 150
103, 217, 173, 150
35, 255, 196, 150""")
# Ladybug/Honeybee Category --> Sub_group_1 Tag {Lbhb_1}
# Ladybug/Honeybee Category --> Sub_group_2 Tag {Lbhb_2}
# Utilities and helpers Category Tag {Uh}
# Group components that support process but don't fit neatly into other categories.
# This could include custom functions, mathematical calculations,
# data manipulation.
# Utilities and helpers Category --> Sub_group_1 Tag {Uh_1}
# Utilities and helpers Category --> Sub_group_2 Tag {Uh_2}
# Visualisation Category Tag {Viz}
# Group components related to visualization
# and data representation. This could encompass tools for creating diagrams,
# charts, render settings, and intermediate result displays
# Visualisations Category --> Sub_group_1 Tag {Viz_1}
# VisualisationsCategory --> Sub_group_2 Tag {Viz_2}
col = Colour(graft(list_of_colors))
# Import/Export Category Tag {Ie}
# Group components for importing external data, such as
# CAD files, spreadsheets, or layers, and exporting data for use in
# other software or for further analysis.
# Import/export Category --> Sub_group_1 Tag {Ie_1}
# Import/export Category --> Sub_group_2 Tag {Ie_2}
# Sampled inputs Category Tag {Samp}
# For all the containers, sldiers or data components that will be
# used to  input data from the sampled database.
# Sampled inputs Category --> Sub_group_1 Tag {Samp_1}
# Sampled inputs Category --> Sub_group_2 Tag {Samp_2}
# Naming Convention
# Name your groups as per the following convention.
# If category :
# Category tag | discription
# Sug_group_1 Tag | discription
# Sug_group_ 2 Tag | discription
# For all scribles group use tag {Scr}
vb = VBScript(name=python.group_names, colour=col)  # -> out, A; inputs colour: Color
# ---------- vb: VB ----------
    Dim doc As GH_Document = owner.OnPingDocument()
    If (doc Is Nothing) Then Return

    For Each obj As IGH_DocumentObject In doc.Objects
      Dim group As Kernel.Special.GH_Group = TryCast(obj, Kernel.Special.GH_Group)
      If (group Is Nothing) Then Continue For
      If (group.NickName.Equals(name, StringComparison.Ordinal)) Then
        group.Colour = colour
      End If
    Next
# ---------- end vb ----------

# ---- group: Uh | Syncing LB components
# Read me !!!
toggle = BooleanToggle(False)
syncghfile = LBSyncGrasshopperFile(sync=toggle)  # -> report; plug-in component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

# ---- group: Uh | Wire display
# Abbreviations:
# CR: Compactness Ratio
# TH : Terraced House
# GF: Ground Floor
# FF: First Floor
# Lds : Loads
# Sch: Schedule
# TZ: Thermal zones
# BBS : Bouwbesluit
number_slider = Slider(1, range=0..2)
wiredisplay = ControlWireDisplay(
    WireDisplay=number_slider,
    AllObjects_Object=[setpt_niemen_living, setpt_niemen_bedrooms, setpt_niemen_kitchen, filter_2, filter_3, set_pt_living_area])

# ---- group: Inp | Selecting sub directory for storing hbjson files / Inp_1 | Directory where hbjson sub diretories are store
# Step 3 : Select the subdirectory from HBjson directory based on the itr (iteration number)
hbjson_dir_path = FilePath("C:\Users\prateekwahi\OneDrive - Delft University of Technology\PhD\7. Reports\3. Papers\3. paper 3\simulations\6.Terraced houses\10.3 updated_cr_logic_supplyT\4. HBjson\")

# ---- group: Inp | Selecting sub directory for storing hbjson files / Bol | Read dir
toggle_2 = BooleanToggle(True)

# ---- group: Out | Reading path to output file / Inp_1 | Directory where input files (sample files) are stored
# Step 2 : Select the output file from the output directory where the outputs needs to be written
output_dir_path = FilePath("C:\Users\prateekwahi\OneDrive - Delft University of Technology\PhD\7. Reports\3. Papers\3. paper 3\simulations\6.Terraced houses\10.3 updated_cr_logic_supplyT\7. Output_excel\")

# ---- group: Out | Reading path to output file / Bol | Read input_dir
toggle_3 = BooleanToggle(True)

# ---- group: Inp | Reading input file from input files diectory and converting it into a path / Bol | Read input_dir
toggle_4 = BooleanToggle(True)

# ---- group: Inp | Reading input file from input files diectory and converting it into a path / Inp_1 | Directory where input files (sample files) are stored
# Sampling and simualtions
# Input and output excel files
# Step 1 : Select the input file from the directory
input_dir_path = FilePath("C:\Users\prateekwahi\OneDrive - Delft University of Technology\PhD\7. Reports\3. Papers\3. paper 3\simulations\6.Terraced houses\10.3 updated_cr_logic_supplyT\3. Input_excel\")

# ---- group: Inp | Selecting sub directory for stroign simulation parameter files / Inp_1 | Directory wheresimulation parameter sub directories are stored
# Step 4 : Select the subdirectory from Sim_par directory based on the itr (iteration number)
simpar_dir_path = FilePath("C:\Users\prateekwahi\OneDrive - Delft University of Technology\PhD\7. Reports\3. Papers\3. paper 3\simulations\6.Terraced houses\10.3 updated_cr_logic_supplyT\5. Sim_par\")

# ---- group: Inp | Selecting sub directory for stroign simulation parameter files / Bol | Read dir
toggle_5 = BooleanToggle(True)

# ---- group: Inp | Selecting sub directory for storing hbjson files
read_dir = GhPythonScript(dir=hbjson_dir_path, read_dir=toggle_2)  # -> sub_dir
# ---------- read_dir: Python ----------
"""
This script reads the names of all directories in a specified directory when a boolean toggle is set to True.

Inputs:
    dir: The path of the directory where subdirectories are stored.
    read_dir: A boolean toggle to check if the directory should be read or not.

Output:
    sub_dir: A list of directory names that the parent directory contains.
"""

__author__ = "prateekwahi"
__version__ = "2023.10.31"

# Import necessary libraries
import rhinoscriptsyntax as rs
from System.IO import Directory, Path, SearchOption

# Initialise output
sub_dir = []

# Check if read_dir is True
if read_dir:
    # Get all subdirectory paths in the directory
    dir_paths = Directory.GetDirectories(dir)
    
    # Get only the directory names from the directory paths
    dir_names = [Path.GetFileName(path) for path in dir_paths]
    
    # Update output with the list of directory names
    sub_dir = dir_names
# ---------- end read_dir ----------
list = ItemSelector(
    read_dir,
    {"2024-04-23_hbjson_itr_1_size_1300_HT", "2024-04-23_hbjson_itr_1_size_1300_LT", "2024-04-23_hbjson_itr_1_size_1300_MT"}, selected="2024-04-23_hbjson_itr_1_size_1300_LT")
dir_path = GhPythonScript(dir=hbjson_dir_path, sub_dir=list)  # -> dir_path
# ---------- dir_path: Python ----------
"""
This script reads the names of all the sub directories in a specified directory and returns the full path of a chosen sub directory.

    Inputs:
        dir: The path of the directory where sub directories are stored.
        sub_dir: The name of the sub directory.

    Output:
        dir_path: The full path of the chosen sub directory.
"""

__author__ = "prateekwahi"
__version__ = "2023.10.23"

# Import necessary libraries
import rhinoscriptsyntax as rs
from System.IO import Directory, Path, SearchOption

# Get all file paths in the directory
file_paths = Directory.GetDirectories(dir)

# Create a dictionary where keys are file names and values are file paths
file_dict = {Path.GetFileName(path): path for path in file_paths}

# Get the file path for the chosen file name
chosen_file_path = file_dict.get(sub_dir)

# Set the output to the full path of the chosen file
dir_path = chosen_file_path
# ---------- end dir_path ----------

# ---- group: Out | Reading path to output file
read_dir_2 = GhPythonScript(dir=output_dir_path, read_dir=toggle_3)  # -> files
# ---------- read_dir_2: Python ----------
"""
This script reads the names of all files in a specified directory when a boolean toggle is set to True.

    Inputs:
        dir: The path of the directory where files are stored.
        read_dir: A boolean toggle to check if the directory should be read or not.

    Output:
    files: A list of file names that the directory contains.
"""

__author__ = "prateekwahi"
__version__ = "2023.10.31"

# Import necessary libraries
import rhinoscriptsyntax as rs
from System.IO import Directory, Path, SearchOption

# Initialise output
files = []

# Check if read_dir is True
if read_dir:
    # Get all file paths in the directory
    file_paths = Directory.GetFiles(dir)
    
    # Get only the file names from the file paths
    file_names = [Path.GetFileName(path) for path in file_paths]
    
    # Update output with the list of file names
    files = file_names
# ---------- end read_dir_2 ----------
list_2 = ItemSelector(
    read_dir_2,
    {"2024-04-23_outputfile_itr_1_size_1300_HT.xlsx", "2024-04-23_outputfile_itr_1_size_1300_LT.xlsx", "2024-04-23_outputfile_itr_1_size_1300_MT.xlsx"}, selected="2024-04-23_outputfile_itr_1_size_1300_LT.xlsx")
file_path = GhPythonScript(dir=output_dir_path, file=list_2)  # -> file_path
# ---------- file_path: Python ----------
"""
This script reads the names of all files in a specified directory and returns the full path of a chosen file.

    Inputs:
        dir: The path of the directory where input files are stored.
        file: The name of the input file.

    Output:
        file_path: The full path of the chosen input file.
"""

__author__ = "prateekwahi"
__version__ = "2023.10.23"

# Import necessary libraries
import rhinoscriptsyntax as rs
from System.IO import Directory, Path, SearchOption

# Get all file paths in the directory
file_paths = Directory.GetFiles(dir)

# Create a dictionary where keys are file names and values are file paths
file_dict = {Path.GetFileName(path): path for path in file_paths}

# Get the file path for the chosen file name
chosen_file_path = file_dict.get(file)

# Set the output to the full path of the chosen file
file_path = chosen_file_path
# ---------- end file_path ----------

# ---- group: Inp | Reading input file from input files diectory and converting it into a path
read_dir_3 = GhPythonScript(dir=input_dir_path, read_dir=toggle_4)  # -> files; same code as read_dir_2
list_3 = ItemSelector(
    read_dir_3,
    {"0. 20231213_allTH_benchmarksamples.xlsx", "2024-04-23_inputfile_itr_1_size_1300.xlsx"}, selected="2024-04-23_inputfile_itr_1_size_1300.xlsx")
file_path_2 = GhPythonScript(dir=input_dir_path, file=list_3)  # -> file_path; same code as file_path

# ---- group: Bol | Iterator for downlaoding Sql
toggle_6 = BooleanToggle(False)

# ---- group: Inp | Selecting sub directory for stroign simulation parameter files
read_dir_4 = GhPythonScript(dir=simpar_dir_path, read_dir=toggle_5)  # -> sub_dir; same code as read_dir
list_4 = ItemSelector(
    read_dir_4,
    {"2024-04-23_simpar_itr_1_size_1300_HT", "2024-04-23_simpar_itr_1_size_1300_LT", "2024-04-23_simpar_itr_1_size_1300_MT"}, selected="2024-04-23_simpar_itr_1_size_1300_LT")
dir_path_2 = GhPythonScript(dir=simpar_dir_path, sub_dir=list_4)  # -> dir_path; same code as dir_path

# ----
location_of_the_director_to_save_sqls = Panel("C:\Users\prateekwahi\OneDrive - Delft University of Technology\PhD\7. Reports\3. Papers\3. paper 3\simulations\6.Terraced houses\8. Sim_2_API\test\Th_hbjson_sample_{0}.sql")
job_list = Slider(199, range=0..199)
colibri_in = ColibriInputsIterator(R=toggle_6, Job_List=job_list, ignoreAllWarningMsg=True)  # -> U, IP, Job_List, V_N
format = Format(Format=location_of_the_director_to_save_sqls, Culture=127, Data0=job_list)

# ---- group: Bol | Reading Results via Hops
toggle_7 = BooleanToggle(False)

# ---- group: Lbhb_1 | Pollination downlaod Sqls
check_study_status = CheckStudyStatus(
    _study="prtkwh-953/SA for NL housing stock. /55860462-06b5-4684-9165-bb7ceb8d15cb",
    Index_=colibri_in.Job_List,
    LiveUpdateStatus=False,
    getBothInputOutputAssets=False)  # -> Status, Finished_run
check_run_results = CheckRunResults(
    _run=check_study_status.Finished_run,
    recipeSource="https://api.pollination.cloud/registries/ladybug-tools/recipe/custom-energy-sim/0.3.19")  # -> Err, Html, Idf, Sql, Zsz
load_assets = LoadAssets(Asset_1=check_run_results.Sql, LiveUpdateStatus=False, postprocessWithHandler=False, useCachedAssets=True)  # -> Logs, Value_1, Value_2

# ---- group: Bol | for reading hbjson and sim par files
toggle_8 = BooleanToggle(True)

# ---- group: Bol | Begin iterating
# Step 6 : Iterating the samples using collibri.
# The slider must be adjusted for number of samples. From 1 to ...N samples
toggle_9 = BooleanToggle(False)

# ---- group: Samp | Number of samples
# Jobs for Pollination
numer_of_samples = Slider(1300, range=1..1300)

# ---- group: Samp_1 | Sampling iterator from excel / Inp_1 | path to excelfile with samples
# Reading samples
# Step 5 : Reading input excel from sampling and decomposing them for individual parameters.
iterator_excel_file = FilePath(file_path_2)

# ---- group: Out | Thermal Comfort : Hours below 20% PPD as underheated hours. / Bol | For_reading_hops
read_results_hops = Boolean(toggle_7)

# ---- group: Out | Space Heating Demand / Bol | For reading hops
read_results_hops_2 = Boolean(toggle_7)

# ---- group: Bol | Reading excel
read_excel = BooleanToggle(True)

# ---- group: Samp_1 | Sampling iterator from excel
xl_in = ReadFromExcel(WorkbookFilepath=iterator_excel_file, Live=False, Stream=read_excel)
viewer = ParamViewer(xl_in)
lng = ListLength(List=viewer)  # -> expr("x-1", Length)
number_of_smaples_range_1_to_this_number = Panel(lng)
sample_number = Data(numer_of_samples)
branch = BranchByIndex(Tree=xl_in, Branch=sample_number)
bang = ExplodeTree(Data=graft(branch))  # -> Branch0, Branch1, Branch2, Branch3, Branch4, Branch5, Branch6, Branch7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

# ---- group: Out | Thermal Comfort : Hours below 20% PPD as underheated hours. / Lbhb_2 | Occupancy pattern for calculating comfort hours.
genes = GenePool(
    Decimals=0,
    Maximum=1,
    Minimum=0,
    Value=[0, 0.5, 0.5, 0.5, 0.5, 0.5, 0.5, 0, 1, 1, 1, 1, 1, 1, 1, 1, 1, 1, 1, 1, 1, 1, 1, 1])
weeklyschedule = HBWeeklySchedule(sun=genes, mon=genes, tue=genes, wed=genes, thu=genes, fri=genes, sat=genes)  # -> report, schedule, idf_year, idf_week, idf_days; plug-in component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
schtodata = HBScheduleToData(schedule=weeklyschedule.schedule)  # -> data; plug-in component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
xdata = LBDeconstructData(data=schtodata)  # -> header, values; plug-in component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

# ----
hbjson_sub_dir_path = Data(dir_path)
simpar_sub_dir_path = Data(dir_path_2)
python_2 = GhPythonScript(original_file=load_assets.Value_1, new_path=format)
# ---------- python_2: Python ----------
"""
This Python script copies a file from the 'original_file' path to the 'new_path'.
    Inputs:
        original_file: The path to the file you want to copy. (Provide the specific file or source path.)
        new_path: The destination path where the file will be copied. (Specify the target directory.)
    Output:
        None
"""

__author__ = "prateekwahi"
__version__ = "2023.09.21"

import rhinoscriptsyntax as rs
import shutil

if original_file and new_path:
    shutil.copy(original_file, new_path)
# ---------- end python_2 ----------

# ---- group: Samp_1 \ Iterator and agregator
colibri_in_2 = ColibriInputsIterator(R=toggle_9, Numer_of_samples=numer_of_samples, ignoreAllWarningMsg=True)  # -> U, IP, Numer_of_samples, V_N

# ---- group: Samp_1 : 0 : HT(90/70), 1: MT(70/50), 2: LT(55/35)
temperature_level = Slider(2, range=0..2)

# ----
path = FilePath("C:\Users\prateekwahi\OneDrive - Delft University of Technology\PhD\7. Reports\3. Papers\3. paper 3\simulations\6.Terraced houses\9.6 supply_temp_9pt5met_api10ddy\10. GBO\2023-01-05_itr_1_size_800.csv")
file = ReadFile(File=path, PerLineParse=True)
panel = Panel("""213.291738
68.76496
85.291565
109.109319
119.803004
197.737287
100.35994
148.805575
116.724519
69.413062
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""")

# ---- group: Out | Cells after sampling
construct_year = Data(bang.Branch1)
rc_gf = Data(bang.Branch5)
u_window = Data(bang.Branch8)
temp_set = Data(bang.Branch12)
orientation = Data(bang.Branch2)
compactness_ratio = Data(bang.Branch3)
rc_roof = Data(bang.Branch7)
u_door = Data(bang.Branch9)
infil = Data(bang.Branch10)
vent_type = Data(bang.Branch11)
sample_number_2 = Data(bang.Branch0)
rc_wall = Data(bang.Branch6)

# ---- group: Lbhb_1 | Model for pollination
job_ids = Panel("Th_simpar_sample_")
sample_number_3 = Data(sample_number_2)
concat = Concatenate(FragmentA=job_ids, FragmentB=sample_number_3)

job_ids_2 = Panel("Th_hbjson_sample_")
sample_number_4 = Data(sample_number_2)
concat_2 = Concatenate(FragmentA=job_ids_2, FragmentB=sample_number_4)

# ----
wwr = Data(bang.Branch4)
lng_2 = ListLength(List=panel)

# ---- group: Out | Reading and writing the outputs / Bol Write to the excel file.
toggle_10 = BooleanToggle(False)

# ---- group: Geo | Generating Geometry : Seed geometry for intermediate TH <1946 / Ie_1 | Roof Layer
# Grashopper definition
# Part 1 : Building Seed Geometry
# Generating Geometry for the seed model.
# The seed model represent the typical terrraced intermediate dwelling.
# The architectrual plan is derived from
# https://www.tweedekamer.nl/downloads/document?id=678fb7be-9748-4d3f-ac1c-200222380a67&title=Referentiewoningen%20nieuwbouw%202006.pdf
pipeline = GeometryPipeline(
    GroupByLayer=False,
    GroupByType=False,
    IncludeHidden=True,
    IncludeLocked=True,
    LayerFilter="Attic",
    NameFilter="*",
    SublayerFiltering=True,
    TypeFilter=5)
srf = Surface(pipeline)

# ---- group: Geo | Generating Geometry : Seed geometry for intermediate TH <1946 / Ie_1 | Ground floor layers
pipeline_2 = GeometryPipeline(
    GroupByLayer=False,
    GroupByType=False,
    IncludeHidden=True,
    IncludeLocked=True,
    LayerFilter="Kitchen",
    NameFilter="*",
    SublayerFiltering=True,
    TypeFilter=5)
pipeline_3 = GeometryPipeline(
    GroupByLayer=False,
    GroupByType=False,
    IncludeHidden=True,
    IncludeLocked=True,
    LayerFilter="Unheated spaces gf",
    NameFilter="*",
    SublayerFiltering=True,
    TypeFilter=5)
pipeline_4 = GeometryPipeline(
    GroupByLayer=False,
    GroupByType=False,
    IncludeHidden=True,
    IncludeLocked=True,
    LayerFilter="Living room",
    NameFilter="*",
    SublayerFiltering=True,
    TypeFilter=5)
srf_2 = Surface(pipeline_2)
srf_3 = Surface(pipeline_3)
srf_4 = Surface(pipeline_4)

# ---- group: Geo | Generating Geometry : Seed geometry for intermediate TH <1946 / Ie_1 | First Floor Layers
pipeline_5 = GeometryPipeline(
    GroupByLayer=False,
    GroupByType=False,
    IncludeHidden=True,
    IncludeLocked=True,
    LayerFilter="Bedroom North",
    NameFilter="*",
    SublayerFiltering=True,
    TypeFilter=5)
pipeline_6 = GeometryPipeline(
    GroupByLayer=False,
    GroupByType=False,
    IncludeHidden=True,
    IncludeLocked=True,
    LayerFilter="Bedroom South",
    NameFilter="*",
    SublayerFiltering=True,
    TypeFilter=5)
pipeline_7 = GeometryPipeline(
    GroupByLayer=False,
    GroupByType=False,
    IncludeHidden=True,
    IncludeLocked=True,
    LayerFilter="Bathrooms",
    NameFilter="*",
    SublayerFiltering=True,
    TypeFilter=5)
pipeline_8 = GeometryPipeline(
    GroupByLayer=False,
    GroupByType=False,
    IncludeHidden=True,
    IncludeLocked=True,
    LayerFilter="Unheated spaces ff",
    NameFilter="*",
    SublayerFiltering=True,
    TypeFilter=5)
srf_5 = Surface(pipeline_5)
srf_6 = Surface(pipeline_6)
srf_7 = Surface(pipeline_7)
srf_8 = Surface(pipeline_8)

# ---- group: Geo | Generating Geometry : Seed geometry for intermediate TH <1946 / Ie_1 | Seed geometry params intermediate TH <1946
floor_to_floor_height = Slider(2.86, range=0..10)
existing_external_length_seed_model = Panel("9.76")
existing_external_width_seed_model = Panel("5.40")
existing_overall_height_seed_model = Panel("10.60")
# Simulation Bools
wwr_of_seed_model = Panel("0.385")

# ---- group: Ie_1 | Door Layer
pipeline_9 = GeometryPipeline(
    GroupByLayer=False,
    GroupByType=False,
    IncludeHidden=True,
    IncludeLocked=True,
    LayerFilter="Door",
    NameFilter="*",
    SublayerFiltering=True,
    TypeFilter=5)
srf_9 = Surface(pipeline_9)

# ---- group: Bol | Local_Simulation
toggle_11 = BooleanToggle(False)

# ---- group: Geo | Generating Geometry : Seed geometry for intermediate TH <1946 / Uh | Extrusion of rooms
entwine = Entwine(
    Branch00=srf_2,
    Branch01=srf_3,
    Branch02=srf_4,
    Branch03=srf_5,
    Branch04=srf_6,
    Branch05=srf_7,
    Branch06=srf_8,
    FlattenInputs=True)
Z = UnitZ(Factor=floor_to_floor_height)
extr = Extrude(Base=entwine, Direction=Z)

# ---- group: Geo | Generating Geometry : Seed geometry for intermediate TH <1946 / Uh | Extrusion of roof
X = UnitX(Factor=existing_external_width_seed_model)
extr_2 = Extrude(Base=srf, Direction=X)

# ---- group: Samp_1 | Orientation
orientation_0_north_270_east_180_south_9 = Panel(orientation)  # "Orientation [ 0:North, 270:East, 180:South, 90: West]"

# ---- group: Inp_1 | Geometry Intermediate TH < 1945
archtype_seed_geometry = Geometry([extr, extr_2])

# ---- group: Samp_1 | 1:A, 2:B, 3:C1, 4: C3c, 5:C3a, 6:D1, 7:D5b
data = Data(flatten(vent_type))
int = Integer(data)
# NTA 8800 chapter 11
vent_sys_type = Data(int)

# ---- group: Samp_1 | Building Envelope : From sampling
door_u_value = Panel(u_door)
ground_floor_r_value = Panel(rc_gf)
wall_r_value = Panel(rc_wall)
pitched_roof_r_value = Panel(rc_roof)
window_u_value = Panel(u_window)

# ---- group: Samp_1 : 0:<1945, 1: 1945-1975, 2:1975-1991, 3: >1991
const_year = Data()

# ---- group: Samp_1 | Inilteration : from sampling
inflteration_dm3_s_m2 = Panel(infil)

# ----
# The SHGC should be changed according to the possibility of
# occuence in each construction year.
# These can be found in voorbeldwoning.
# SHGC typical values from NTA8800 table 7.4
shgc_dgu = Panel("0.75")

# ---- group: Geo | Geometry intersection for adjancy test / Lbhb_1 / Bol
toggle_12 = BooleanToggle(True)

# ---- group: Bol | Adj_1
toggle_13 = BooleanToggle(True)

# ---- group: Bol | Adj_2
toggle_14 = BooleanToggle(True)

# ---- group: Bol | Adj_3
toggle_15 = BooleanToggle(True)

# ---- group: Bol
bool_for_adiabatic_external_surface = Boolean([False, True, False, True])

# ---- group: Lbhb | Model with windows, openings and ventilation / Inp_1 | Vent system sampling
# 3B: Adding openings to HB model
# Adding windows and doors to the HB model. Bools for checking when to include window openign and when not to.
ventilation_system = Data(vent_sys_type)

# ---- group: Lbhb | Model with windows, openings and ventilation / Geo_1 | Door Geometry
door = Geometry(srf_9)

# ---- group: Lbhb | building envelope properties through R values. / Lbhb_1 | Material Set
door_u_value_2 = Data(door_u_value)
u_value = Division(A="1", B=door_u_value_2)
# 4A: Building envelope insulation
# Using R value input from sampling. Excludes thermal mass. Should be revisted later.
panel_2 = Panel("Ground Floor")
ground_floor = Data(ground_floor_r_value)
external_wall = Data(wall_r_value)
pitched_roof = Data(pitched_roof_r_value)
windows = Data(window_u_value)
door_2 = Data(u_value)
dgu = Data(shgc_dgu)
opaquematnomass = HBOpaqueMaterialNoMass(name=panel_2, r_value=ground_floor)  # -> mat; plug-in component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
opaquematnomass_2 = HBOpaqueMaterialNoMass(name="Pitched Roof", r_value=pitched_roof)  # -> mat; plug-in component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
opaquematnomass_3 = HBOpaqueMaterialNoMass(name="External Wall", r_value=external_wall)  # -> mat; plug-in component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
windowmat = HBWindowMaterial(u_factor=windows, shgc=dgu)  # -> mat; plug-in component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
opaquematnomass_4 = HBOpaqueMaterialNoMass(name="Door", r_value=door_2)  # -> mat; plug-in component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
opaqueconstr = HBOpaqueConstruction(name=panel_2, materials=opaquematnomass)  # -> constr; plug-in component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
opaqueconstr_2 = HBOpaqueConstruction(name="Pitched Roof", materials=opaquematnomass_2)  # -> constr; plug-in component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
opaqueconstr_3 = HBOpaqueConstruction(name="External Wall", materials=opaquematnomass_3)  # -> constr; plug-in component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
windowconstr = HBWindowConstruction(name="Windows", materials=windowmat)  # -> constr; plug-in component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
opaqueconstr_4 = HBOpaqueConstruction(name="Door", materials=opaquematnomass_4)  # -> constr; plug-in component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

# ---- group: Lbhb | building envelope properties through R values. / Lbhb_1 | Material set for internal construction
opaquematnomass_5 = HBOpaqueMaterialNoMass(name="Internal Partitions", r_value="0.20")  # -> mat; plug-in component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
opaquematnomass_6 = HBOpaqueMaterialNoMass(name="Internal Floor", r_value="0.15")  # -> mat; plug-in component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
opaqueconstr_5 = HBOpaqueConstruction(name="Internal Partitions", materials=opaquematnomass_5)  # -> constr; plug-in component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
opaqueconstr_6 = HBOpaqueConstruction(name="Internal Floor", materials=opaquematnomass_6)  # -> constr; plug-in component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

# ---- group: Uh | Calculating compactness ratio / Geo_1 | Reference of rhino brep of roof
rhino_brep__roof = Brep(extr_2)

# ---- group: Uh | Calculating compactness ratio / Uh_1 | Usable roof floor area external dim
debrep = DeconstructBrep(Brep=rhino_brep__roof)  # -> Faces, Edges, Vertices
item = ListItem(List=debrep.Vertices, Index=0, Wrap=True)
min_height_for_usable_area = Panel("1.5")
contour = Contour(Shape=rhino_brep__roof, Point=item, Direction=Vector(0, 0, 1), Distance=min_height_for_usable_area)
item_2 = ListItem(List=flatten(contour), Index=0, Wrap=True)  # -> Item, Item1
usable_area_curve = Curve(item_2.Item1)
area = Area(Geometry=usable_area_curve)  # -> Area, Centroid

# ---- group: Uh | Calculating compactness ratio / Uh_1 | Cal. Roof floor Area External Dim.
roof_floor_index = Panel("3")
item_3 = ListItem(List=debrep.Faces, Index=roof_floor_index, Wrap=True)
area_2 = Area(Geometry=item_3)  # -> Area, Centroid

# ---- group: Lbhb_1 | If Temp_set sample is 19 / Lbhb_2 | Bedroom nightsetback 17
genes_2 = GenePool(
    Decimals=0,
    Maximum=17.001,
    Minimum=17,
    Value=[17.001, 17.001, 17.001, 17.001, 17.001, 17.001, 17.001, 17.001, 17, 17, 17, 17, 17, 17, 17, 17, 17, 17, 17, 17, 17, 17, 17, 17.001])
weeklyschedule_2 = HBWeeklySchedule(sun=genes_2, mon=genes_2, tue=genes_2, wed=genes_2, thu=genes_2, fri=genes_2, sat=genes_2, type_limit="Temperature")  # -> report, schedule, idf_year, idf_week, idf_days; plug-in component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

# ---- group: Lbhb_1 | If Temp_set sample is 19 / Lbhb_2 | Livingarea setpoint 19
genes_3 = GenePool(
    Decimals=0,
    Maximum=19.001,
    Minimum=19,
    Value=[19, 19, 19, 19, 19, 19, 19, 19, 19.001, 19.001, 19.001, 19.001, 19.001, 19.001, 19.001, 19.001, 19.001, 19.001, 19.001, 19.001, 19.001, 19.001, 19.001, 19])
weeklyschedule_3 = HBWeeklySchedule(sun=genes_3, mon=genes_3, tue=genes_3, wed=genes_3, thu=genes_3, fri=genes_3, sat=genes_3, type_limit="Temperature")  # -> report, schedule, idf_year, idf_week, idf_days; plug-in component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

# ---- group: Lbhb_1 | If Temp_set sample is 18 / Lbhb_2 | Bedroom nightsetback_16
genes_4 = GenePool(
    Decimals=0,
    Maximum=16.001,
    Minimum=16,
    Value=[16.001, 16.001, 16.001, 16.001, 16.001, 16.001, 16.001, 16.001, 16, 16, 16, 16, 16, 16, 16, 16, 16, 16, 16, 16, 16, 16, 16, 16.001])
weeklyschedule_4 = HBWeeklySchedule(sun=genes_4, mon=genes_4, tue=genes_4, wed=genes_4, thu=genes_4, fri=genes_4, sat=genes_4, type_limit="Temperature")  # -> report, schedule, idf_year, idf_week, idf_days; plug-in component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

# ---- group: Lbhb_1 | If Temp_set sample is 18 / Lbhb_2 | Livingarea setpoint 18
genes_5 = GenePool(
    Decimals=0,
    Maximum=18.001,
    Minimum=18,
    Value=[18, 18, 18, 18, 18, 18, 18, 18, 18.001, 18.001, 18.001, 18.001, 18.001, 18.001, 18.001, 18.001, 18.001, 18.001, 18.001, 18.001, 18.001, 18.001, 18.001, 18])
weeklyschedule_5 = HBWeeklySchedule(sun=genes_5, mon=genes_5, tue=genes_5, wed=genes_5, thu=genes_5, fri=genes_5, sat=genes_5, type_limit="Temperature")  # -> report, schedule, idf_year, idf_week, idf_days; plug-in component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

# ---- group: Lbhb_1 | If Temp_set sample is 20 / Lbhb_2 | Bedroom nightsetback 18
genes_6 = GenePool(
    Decimals=0,
    Maximum=18.001,
    Minimum=18,
    Value=[18.001, 18.001, 18.001, 18.001, 18.001, 18.001, 18.001, 18.001, 18, 18, 18, 18, 18, 18, 18, 18, 18, 18, 18, 18, 18, 18, 18, 18.001])
weeklyschedule_6 = HBWeeklySchedule(sun=genes_6, mon=genes_6, tue=genes_6, wed=genes_6, thu=genes_6, fri=genes_6, sat=genes_6, type_limit="Temperature")  # -> report, schedule, idf_year, idf_week, idf_days; plug-in component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

# ---- group: Lbhb_1 | If Temp_set sample is 20 / Lbhb_2 | Livingarea setpoint 20
genes_7 = GenePool(
    Decimals=0,
    Maximum=20.001,
    Minimum=20,
    Value=[20, 20, 20, 20, 20, 20, 20, 20, 20.001, 20.001, 20.001, 20.001, 20.001, 20.001, 20.001, 20.001, 20.001, 20.001, 20.001, 20.001, 20.001, 20.001, 20.001, 20])
weeklyschedule_7 = HBWeeklySchedule(sun=genes_7, mon=genes_7, tue=genes_7, wed=genes_7, thu=genes_7, fri=genes_7, sat=genes_7, type_limit="Temperature")  # -> report, schedule, idf_year, idf_week, idf_days; plug-in component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

# ---- group: Lbhb_1 | If Temp_set sample is 21 / Lbhb_2 | Bedroom nightsetback 19
genes_8 = GenePool(
    Decimals=0,
    Maximum=19.001,
    Minimum=19,
    Value=[19.001, 19.001, 19.001, 19.001, 19.001, 19.001, 19.001, 19.001, 19, 19, 19, 19, 19, 19, 19, 19, 19, 19, 19, 19, 19, 19, 19, 19.001])
weeklyschedule_8 = HBWeeklySchedule(sun=genes_8, mon=genes_8, tue=genes_8, wed=genes_8, thu=genes_8, fri=genes_8, sat=genes_8, type_limit="Temperature")  # -> report, schedule, idf_year, idf_week, idf_days; plug-in component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

# ---- group: Lbhb_1 | If Temp_set sample is 21 / Lbhb_2 | Livingarea setpoint 21
genes_9 = GenePool(
    Decimals=0,
    Maximum=21.001,
    Minimum=21,
    Value=[21, 21, 21, 21, 21, 21, 21, 21, 21.001, 21.001, 21.001, 21.001, 21.001, 21.001, 21.001, 21.001, 21.001, 21.001, 21.001, 21.001, 21.001, 21.001, 21.001, 21])
weeklyschedule_9 = HBWeeklySchedule(sun=genes_9, mon=genes_9, tue=genes_9, wed=genes_9, thu=genes_9, fri=genes_9, sat=genes_9, type_limit="Temperature")  # -> report, schedule, idf_year, idf_week, idf_days; plug-in component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

# ---- group: Lbhb | Programme : Schedule, loads and setpoints / Lbhb_1 | Infilteration calcutions for entire house / Inp_1 | Inf rate from sampling
inf_dm3_s_m2 = Data(inflteration_dm3_s_m2)

# ---- group: Lbhb | Programme : Schedule, loads and setpoints / Lbhb_2 | Number of occupants
num_occ = Slider(3, range=0..4)

# ---- group: Lbhb | Programme : Schedule, loads and setpoints / Inp_2 | Fixed Lighting loads
fixed_light_loads_for_dwelling_w_m2 = Panel("2")

# ---- group: Lbhb | Programme : Schedule, loads and setpoints / Inp_2 | Fixed Equipment Loads
fixed_equipment_loads_for_dwelling_w_m2 = Panel("2")

# ---- group: Lbhb | Programme : Schedule, loads and setpoints / Lbhb_2 | Housing gains (OCC, Light, Equip)
genes_10 = GenePool(
    Decimals=1,
    Maximum=1,
    Minimum=0,
    Value=[0.5, 0.5, 0.5, 0.5, 0.5, 0.5, 0.5, 0.5, 1, 1, 1, 1, 1, 1, 1, 1, 1, 1, 1, 1, 1, 1, 1, 0.5])
weeklyschedule_10 = HBWeeklySchedule(
    sun=genes_10,
    mon=genes_10,
    tue=genes_10,
    wed=genes_10,
    thu=genes_10,
    fri=genes_10,
    sat=genes_10,
    name="Occupancy_pattern_gains")  # -> report, schedule, idf_year, idf_week, idf_days; plug-in component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

# ---- group: Lbhb | Programme : Schedule, loads and setpoints / Inp_1 | Temp_setpoint from sample
temp_setpoint_sample = Data(temp_set)

# ---- group: Lbhb | Programme : Schedule, loads and setpoints / Lbhb_1 | If the setpoint 21 / Lbhb_2 | Bedroom nightsetback 19
genes_11 = GenePool(
    Decimals=0,
    Maximum=19.001,
    Minimum=19,
    Value=[19.001, 19.001, 19.001, 19.001, 19.001, 19.001, 19.001, 19.001, 19, 19, 19, 19, 19, 19, 19, 19, 19, 19, 19, 19, 19, 19, 19, 19.001])
weeklyschedule_11 = HBWeeklySchedule(
    sun=genes_11,
    mon=genes_11,
    tue=genes_11,
    wed=genes_11,
    thu=genes_11,
    fri=genes_11,
    sat=genes_11,
    type_limit="Temperature")  # -> report, schedule, idf_year, idf_week, idf_days; plug-in component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

# ---- group: Lbhb | Programme : Schedule, loads and setpoints / Lbhb_1 | If the setpoint 21
genes_12 = GenePool(
    Decimals=0,
    Maximum=21.001,
    Minimum=21,
    Value=[21, 21, 21, 21, 21, 21, 21, 21, 21.001, 21.001, 21.001, 21.001, 21.001, 21.001, 21.001, 21.001, 21.001, 21.001, 21.001, 21.001, 21.001, 21.001, 21.001, 21])
weeklyschedule_12 = HBWeeklySchedule(
    sun=genes_12,
    mon=genes_12,
    tue=genes_12,
    wed=genes_12,
    thu=genes_12,
    fri=genes_12,
    sat=genes_12,
    type_limit="Temperature")  # -> report, schedule, idf_year, idf_week, idf_days; plug-in component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

# ---- group: Lbhb | Programme : Schedule, loads and setpoints / Lbhb_1 | If the setpoint 20 / Lbhb_2 | Bedroom nightsetback 18
genes_13 = GenePool(
    Decimals=0,
    Maximum=18.001,
    Minimum=18,
    Value=[18.001, 18.001, 18.001, 18.001, 18.001, 18.001, 18.001, 18.001, 18, 18, 18, 18, 18, 18, 18, 18, 18, 18, 18, 18, 18, 18, 18, 18.001])
weeklyschedule_13 = HBWeeklySchedule(
    sun=genes_13,
    mon=genes_13,
    tue=genes_13,
    wed=genes_13,
    thu=genes_13,
    fri=genes_13,
    sat=genes_13,
    type_limit="Temperature")  # -> report, schedule, idf_year, idf_week, idf_days; plug-in component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

# ---- group: Lbhb | Programme : Schedule, loads and setpoints / Lbhb_1 | If the setpoint 20
genes_14 = GenePool(
    Decimals=0,
    Maximum=20.001,
    Minimum=20,
    Value=[20, 20, 20, 20, 20, 20, 20, 20, 20.001, 20.001, 20.001, 20.001, 20.001, 20.001, 20.001, 20.001, 20.001, 20.001, 20.001, 20.001, 20.001, 20.001, 20.001, 20])
weeklyschedule_14 = HBWeeklySchedule(
    sun=genes_14,
    mon=genes_14,
    tue=genes_14,
    wed=genes_14,
    thu=genes_14,
    fri=genes_14,
    sat=genes_14,
    type_limit="Temperature")  # -> report, schedule, idf_year, idf_week, idf_days; plug-in component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

# ---- group: Lbhb | Programme : Schedule, loads and setpoints / Lbhb_1 | If the setpoint 18 / Lbhb_2 | Bedroom nightsetback_16
genes_15 = GenePool(
    Decimals=0,
    Maximum=16.001,
    Minimum=16,
    Value=[16.001, 16.001, 16.001, 16.001, 16.001, 16.001, 16.001, 16.001, 16, 16, 16, 16, 16, 16, 16, 16, 16, 16, 16, 16, 16, 16, 16, 16.001])
weeklyschedule_15 = HBWeeklySchedule(
    sun=genes_15,
    mon=genes_15,
    tue=genes_15,
    wed=genes_15,
    thu=genes_15,
    fri=genes_15,
    sat=genes_15,
    type_limit="Temperature")  # -> report, schedule, idf_year, idf_week, idf_days; plug-in component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

# ---- group: Lbhb | Programme : Schedule, loads and setpoints / Lbhb_1 | If the setpoint 18
genes_16 = GenePool(
    Decimals=0,
    Maximum=18.001,
    Minimum=18,
    Value=[18, 18, 18, 18, 18, 18, 18, 18, 18.001, 18.001, 18.001, 18.001, 18.001, 18.001, 18.001, 18.001, 18.001, 18.001, 18.001, 18.001, 18.001, 18.001, 18.001, 18])
weeklyschedule_16 = HBWeeklySchedule(
    sun=genes_16,
    mon=genes_16,
    tue=genes_16,
    wed=genes_16,
    thu=genes_16,
    fri=genes_16,
    sat=genes_16,
    type_limit="Temperature")  # -> report, schedule, idf_year, idf_week, idf_days; plug-in component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

# ---- group: Lbhb | Programme : Schedule, loads and setpoints / Lbhb_1 | Neiman setpoint for const year before 1975
genes_17 = GenePool(
    Decimals=0,
    Maximum=20.001,
    Minimum=20,
    Value=[20, 20, 20, 20, 20, 20, 20, 20, 20.001, 20.001, 20.001, 20.001, 20.001, 20.001, 20.001, 20.001, 20.001, 20.001, 20.001, 20.001, 20.001, 20.001, 20.001, 20])
weeklyschedule_17 = HBWeeklySchedule(
    sun=genes_17,
    mon=genes_17,
    tue=genes_17,
    wed=genes_17,
    thu=genes_17,
    fri=genes_17,
    sat=genes_17,
    type_limit="Temperature")  # -> report, schedule, idf_year, idf_week, idf_days; plug-in component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

# ---- group: Lbhb | Programme : Schedule, loads and setpoints / Lbhb_1 | If the setpoint 19 / Lbhb_2 | Bedroom nightsetback 17
genes_18 = GenePool(
    Decimals=0,
    Maximum=17.001,
    Minimum=17,
    Value=[17.001, 17.001, 17.001, 17.001, 17.001, 17.001, 17.001, 17.001, 17, 17, 17, 17, 17, 17, 17, 17, 17, 17, 17, 17, 17, 17, 17, 17.001])
weeklyschedule_18 = HBWeeklySchedule(
    sun=genes_18,
    mon=genes_18,
    tue=genes_18,
    wed=genes_18,
    thu=genes_18,
    fri=genes_18,
    sat=genes_18,
    type_limit="Temperature")  # -> report, schedule, idf_year, idf_week, idf_days; plug-in component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

# ---- group: Lbhb | Programme : Schedule, loads and setpoints / Lbhb_2 | Cooling Schedule Fixed as per EN16798-1
constantschedule = HBConstantSchedule(values="24", name="cooling", type_limit="Temperature")  # -> report, schedule, idf_text; plug-in component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

# ---- group: Lbhb | Programme : Schedule, loads and setpoints / Lbhb_1 | If the setpoint 19
genes_19 = GenePool(
    Decimals=0,
    Maximum=19.001,
    Minimum=19,
    Value=[19, 19, 19, 19, 19, 19, 19, 19, 19.001, 19.001, 19.001, 19.001, 19.001, 19.001, 19.001, 19.001, 19.001, 19.001, 19.001, 19.001, 19.001, 19.001, 19.001, 19])
weeklyschedule_19 = HBWeeklySchedule(
    sun=genes_19,
    mon=genes_19,
    tue=genes_19,
    wed=genes_19,
    thu=genes_19,
    fri=genes_19,
    sat=genes_19,
    type_limit="Temperature")  # -> report, schedule, idf_year, idf_week, idf_days; plug-in component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

# ---- group: Lbhb | Programme : Schedule, loads and setpoints / Lbhb_1 | Neiman setpoint for const year after 1975 / Lbhb_2 | Bedroom nightsetback_16
genes_20 = GenePool(
    Decimals=0,
    Maximum=20.001,
    Minimum=20,
    Value=[20.001, 20.001, 20.001, 20.001, 20.001, 20.001, 20.001, 20.001, 20, 20, 20, 20, 20, 20, 20, 20, 20, 20, 20, 20, 20, 20, 20, 20.001])
weeklyschedule_20 = HBWeeklySchedule(
    sun=genes_20,
    mon=genes_20,
    tue=genes_20,
    wed=genes_20,
    thu=genes_20,
    fri=genes_20,
    sat=genes_20,
    type_limit="Temperature")  # -> report, schedule, idf_year, idf_week, idf_days; plug-in component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

# ---- group: Lbhb | Programme : Schedule, loads and setpoints / Lbhb_1 | Neiman setpoint for const year before 1975 / Lbhb_2 | Bedroom nightsetback_16
genes_21 = GenePool(
    Decimals=0,
    Maximum=16.001,
    Minimum=16,
    Value=[16.001, 16.001, 16.001, 16.001, 16.001, 16.001, 16.001, 16.001, 16, 16, 16, 16, 16, 16, 16, 16, 16, 16, 16, 16, 16, 16, 16, 16.001])
weeklyschedule_21 = HBWeeklySchedule(
    sun=genes_21,
    mon=genes_21,
    tue=genes_21,
    wed=genes_21,
    thu=genes_21,
    fri=genes_21,
    sat=genes_21,
    type_limit="Temperature")  # -> report, schedule, idf_year, idf_week, idf_days; plug-in component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

# ---- group: Lbhb | Programme : Schedule, loads and setpoints / Lbhb_1 | Neiman setpoint for const year after 1975
genes_22 = GenePool(
    Decimals=0,
    Maximum=20.001,
    Minimum=20,
    Value=[20, 20, 20, 20, 20, 20, 20, 20, 20.001, 20.001, 20.001, 20.001, 20.001, 20.001, 20.001, 20.001, 20.001, 20.001, 20.001, 20.001, 20.001, 20.001, 20.001, 20])
weeklyschedule_22 = HBWeeklySchedule(
    sun=genes_22,
    mon=genes_22,
    tue=genes_22,
    wed=genes_22,
    thu=genes_22,
    fri=genes_22,
    sat=genes_22,
    type_limit="Temperature")  # -> report, schedule, idf_year, idf_week, idf_days; plug-in component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

# ---- group: Lbhb | Programme : Schedule, loads and setpoints / Lbhb_1 | Infilteration calcutions for entire house / Uh_2 | conversion q10 to q4
expression = Expression(Q10=inf_dm3_s_m2, Expression="(Q10*0.001)/1.847")

# ---- group: Lbhb | Programme : Schedule, loads and setpoints / Uh_1 | Ventilation schedules and rates based on ventilation system
type_vent_sys = Data(vent_sys_type)
vent_rate_liv_dm3_s_per_m2_bbs = Panel("0.9")
vent_helper = GhPythonScript(flow_per_area=vent_rate_liv_dm3_s_per_m2_bbs, vent_sys=type_vent_sys)  # -> out, adj_flow_per_area, DDV_sch; inputs vent_sys: Int32
# ---------- vent_helper: Python ----------
"""
Controls the application of schedule for demand control, systems. 
If there is demand control that is ventilation system beyond C1 or D1, then DDV_sch
will be used for adding schedule to ventialtion component. The schedule is same as occupancy. 
-

    Args:
         flow_per_area : Flow rate as per building decree. 
         Vent_sys : Ventilation system type from sampling. 

    Returns:
        out : output report
        adj_flow_per_area : adjusted flow rate based on ventilation system.
                            only happens with HR or system D where outside treated air is reduced by atleast 50%. 
                            This reduction is based on HR efficiency. 
        DDV_sch : The schedule boolean, based on ventilation system. 
"""

__author__ = "prateekwahi"
__version__ = "2023.09.13"

import rhinoscriptsyntax as rs
if vent_sys == 1:           # natural vent
    DDV_sch = 0             # No demand control 
    adj_flow_per_area = flow_per_area
elif vent_sys == 3:         # Natural supply mechnical exhaust no control
    DDV_sch = 0             # no demand constrol
    adj_flow_per_area = flow_per_area
elif vent_sys == 4 or vent_sys == 5: # Ventilation system C variants
    DDV_sch = 1             # Demand Control
    adj_flow_per_area = flow_per_area
elif vent_sys == 6 or vent_sys == 7:    # balanced with HR
    DDV_sch = 0
    adj_flow_per_area = flow_per_area * 0.5
# ---------- end vent_helper ----------
convert_dm3_s_to_m3_s = Panel("1000")
division = Division(A=vent_helper.adj_flow_per_area, B=convert_dm3_s_to_m3_s)

vent_rate_bed_dm3_s_per_m2_bbs = Panel("0.9")
type_vent_sys_2 = Data(vent_sys_type)
vent_helper_2 = GhPythonScript(flow_per_area=vent_rate_bed_dm3_s_per_m2_bbs, vent_sys=type_vent_sys_2)  # -> out, adj_flow_per_area, DDV_sch; inputs vent_sys: Int32; same code as vent_helper
convert_dm3_s_to_m3_s_2 = Panel("1000")
division_2 = Division(A=vent_helper_2.adj_flow_per_area, B=convert_dm3_s_to_m3_s_2)

# ---- group: Uh | Calculating Heating Capcities for HT, MT and LT / Inp_2 | Temperature level
temperature_level_2 = Data(temperature_level)

# ----
panel_3 = Panel("""2425.051977
1416.467415
1705.663597
1719.118752""")

# ---- group: Out | Space Heating Demand
# Hops componenet
# 1. run hops_sql_PW
# 2. Server name : http://127.0.0.1:5000
# 3. endpoint for heating : /heating_kwh
# 4. endpoint for coldhours : /temperature
# 5. right click --> path --> servername/endpoint
# ex: http://127.0.0.1:5000/heating_kwh
conditioned_spaces = Panel("Living,Kitchen,BedroomNorth,BedroomSouth")

# ---- group: Lbhb | Simulation / Inp_1 | Orientation
# 7b : Simulation Outputs_using Hops
orientation_of_model = FilePath(orientation_0_north_270_east_180_south_9)

# ---- group: Out | Thermal Comfort : Hours below 20% PPD as underheated hours. / Bol | For_reading_hops
read_results_hops_3 = Boolean(toggle_7)

# ---- group: Out | Thermal Comfort : Hours below 20% PPD as underheated hours.
# Hops componenet
# 1. run hops_sql_PW
# 2. Server name : http://127.0.0.1:5000
# 3. endpoint for heating : /heating_kwh
# 4. endpoint for coldhours : /temperature
# 5. right click --> path --> servername/endpoint
# ex: http://127.0.0.1:5000/temperature
# ReadingJson output
# The Hops component convert the
# list/datframe into json string.
# The json string is read into ironpython componenet.
zone_name_for_ot = Panel("Living")

# ---- group: Lbhb | Simulation / Bol | Custom outputs
toggle_16 = BooleanToggle(True)

# ---- group: Lbhb | Simulation / Inp_1 | NEN 5060 EPW file
nen_5060_epw = FilePath("C:\Users\prateekwahi\OneDrive - Delft University of Technology\PhD\7. Reports\3. Papers\3. paper 3\simulations\6.Terraced houses\4. Weather Files\Simulation files used\PW_NEN5060_2021_EPW.epw")

# ---- group: Out | Thermal Comfort : Hours below 20% PPD as underheated hours. / Inp_1 | Weather file
epw_file = Data(nen_5060_epw)

# ---- group: Out | Thermal Comfort : Hours below 20% PPD as underheated hours. / Lbhb_2 | Reading outdoor DBT
importepw = LBImportEPW(epw_file=epw_file)  # -> location, dry_bulb_temperature, dew_point_temperature, relative_humidity, wind_speed, wind_direction, direct_normal_rad, diffuse_horizontal_rad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; plug-in component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
timeop = LBTimeIntervalOperation(data=importepw.dry_bulb_temperature, operation="average")  # -> daily, monthly, mon_per_hr; plug-in component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
xdata_2 = LBDeconstructData(data=timeop.daily)  # -> header, values; plug-in component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

# ---- group: Out | Thermal Comfort : Hours below 20% PPD as underheated hours. / Inp_1 | Weather file
epw_file_2 = Data(nen_5060_epw)

# ----
saving_sim_files = FilePath("C:\Users\prateekwahi\OneDrive - Delft University of Technology\PhD\7. Reports\3. Papers\3. paper 3\simulations\6.Terraced houses\5. Results\Script testing\paper3\")

# ---- group: Out | Space Heating Demand / Bol | For reading hops
read_results_hops_4 = Boolean(toggle_7)

# ---- group: Bol | For simualtion run
simulation_bool = Boolean(toggle_11)

# ---- group: Out | Thermal Comfort : Hours below 20% PPD as underheated hours. / Lbhb_2 | Reading outdoor DBT
importepw_2 = LBImportEPW(epw_file=epw_file_2)  # -> location, dry_bulb_temperature, dew_point_temperature, relative_humidity, wind_speed, wind_direction, direct_normal_rad, diffuse_horizontal_rad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; plug-in component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
timeop_2 = LBTimeIntervalOperation(data=importepw_2.dry_bulb_temperature, operation="average")  # -> daily, monthly, mon_per_hr; plug-in component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
xdata_3 = LBDeconstructData(data=timeop_2.daily)  # -> header, values; plug-in component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

# ---- group: Out | Thermal Comfort : Hours below 20% PPD as underheated hours. / Lbhb_2 | Occupancy pattern for calculating comfort hours.
genes_23 = GenePool(
    Decimals=0,
    Maximum=1,
    Minimum=0,
    Value=[0, 0.5, 0.5, 0.5, 0.5, 0.5, 0.5, 0, 1, 1, 1, 1, 1, 1, 1, 1, 1, 1, 1, 1, 1, 1, 1, 1])
weeklyschedule_23 = HBWeeklySchedule(sun=genes_23, mon=genes_23, tue=genes_23, wed=genes_23, thu=genes_23, fri=genes_23, sat=genes_23)  # -> report, schedule, idf_year, idf_week, idf_days; plug-in component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
schtodata_2 = HBScheduleToData(schedule=weeklyschedule_23.schedule)  # -> data; plug-in component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
xdata_4 = LBDeconstructData(data=schtodata_2)  # -> header, values; plug-in component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

# ----
panel_4 = Panel(epw_file_2)

# ---- group: Out | Thermal Comfort : Hours below 20% PPD as underheated hours. / Inp_1 | Weather file
epw_file_3 = Data(panel_4)

# ---- group: Out | Thermal Comfort : Hours below 20% PPD as underheated hours. / Lbhb_2 | Occupancy pattern for calculating comfort hours.
genes_24 = GenePool(
    Decimals=0,
    Maximum=1,
    Minimum=0,
    Value=[0, 0.5, 0.5, 0.5, 0.5, 0.5, 0.5, 0, 1, 1, 1, 1, 1, 1, 1, 1, 1, 1, 1, 1, 1, 1, 1, 1])
weeklyschedule_24 = HBWeeklySchedule(sun=genes_24, mon=genes_24, tue=genes_24, wed=genes_24, thu=genes_24, fri=genes_24, sat=genes_24)  # -> report, schedule, idf_year, idf_week, idf_days; plug-in component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
schtodata_3 = HBScheduleToData(schedule=weeklyschedule_24.schedule)  # -> data; plug-in component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
xdata_5 = LBDeconstructData(data=schtodata_3)  # -> header, values; plug-in component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

# ---- group: Out | Thermal Comfort : Hours below 20% PPD as underheated hours. / Lbhb_2 | Reading outdoor DBT
importepw_3 = LBImportEPW(epw_file=epw_file_3)  # -> location, dry_bulb_temperature, dew_point_temperature, relative_humidity, wind_speed, wind_direction, direct_normal_rad, diffuse_horizontal_rad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; plug-in component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
timeop_3 = LBTimeIntervalOperation(data=importepw_3.dry_bulb_temperature, operation="average")  # -> daily, monthly, mon_per_hr; plug-in component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
xdata_6 = LBDeconstructData(data=timeop_3.daily)  # -> header, values; plug-in component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

# ---- group: Out | Space Heating Demand
conditioned_spaces_2 = Panel("Living,Kitchen,BedroomNorth,BedroomSouth")
# Reading Sqls and writing them in the excel
# Step 9: Reading space heating demand and comfort hours for the all sql files.
# Note: Enable the server for hops
sql_path = FilePath(["C:\Users\prateekwahi\OneDrive - Delft University of Technology\PhD\7. Reports\3. Papers\3. paper 3\simulations\6.Terraced houses\10.3 updated_cr_logic_supplyT\6. Sql_files\2024-04-23_sqlfiles_itr_1_size_1300_LT\Th_hbjson_sample_1.sql", "C:\Users\prateekwahi\OneDrive - Delft University of Technology\PhD\7. Reports\3. Papers\3. paper 3\simulations\6.Terraced houses\10.3 updated_cr_logic_supplyT\6. Sql_files\2024-04-23_sqlfiles_itr_1_size_1300_LT\Th_hbjson_sample_2.sql", "C:\Users\prateekwahi\OneDrive - Delft University of Technology\PhD\7. Reports\3. Papers\3. paper 3\simulations\6.Terraced houses\10.3 updated_cr_logic_supplyT\6. Sql_files\2024-04-23_sqlfiles_itr_1_size_1300_LT\Th_hbjson_sample_3.sql", "C:\Users\prateekwahi\OneDrive - Delft University of Technology\PhD\7. Reports\3. Papers\3. paper 3\simulations\6.Terraced houses\10.3 updated_cr_logic_supplyT\6. Sql_files\2024-04-23_sqlfiles_itr_1_size_1300_LT\Th_hbjson_sample_4.sql", "C:\Users\prateekwahi\OneDrive - Delft University of Technology\PhD\7. Reports\3. Papers\3. paper 3\simulations\6.Terraced houses\10.3 updated_cr_logic_supplyT\6. Sql_files\2024-04-23_sqlfiles_itr_1_size_1300_LT\Th_hbjson_sample_5.sql", "C:\Users\prateekwahi\OneDrive - Delft University of Technology\PhD\7. Reports\3. Papers\3. paper 3\simulations\6.Terraced houses\10.3 updated_cr_logic_supplyT\6. Sql_files\2024-04-23_sqlfiles_itr_1_size_1300_LT\Th_hbjson_sample_6.sql"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])

# ---- group: Out | Space Heating Demand / Uh_1 | Hops for reading SQL faster.
heating_hops = Hops(
    _Enabled=read_results_hops_2,
    SQLPath=sql_path,
    ZoneNames=conditioned_spaces_2,
    CacheResultsInMemory=False,
    CacheSolveResults=False,
    RemoteDefinitionLocation="http://127.0.0.1:5000/heating_kwh",
    RemoteSolveVersion=(0, 1, 0),
    ShowInput_Enabled=True,
    ShowInput_Path=False,
    SynchronousSolve=True)

# ----
panel_5 = Panel(heating_hops)

# ---- group: Out | Thermal Comfort : Hours below 20% PPD as underheated hours.
# ReadingJson output
# The Hops component convert the
# list/datframe into json string.
# The json string is read into ironpython componenet.
zone_name_for_ot_2 = Panel("Living")

# ---- group: Out | Thermal Comfort : Hours below 20% PPD as underheated hours. / Uh_1 | Hops for reading SQL faster.
ot_hops = Hops(
    _Enabled=read_results_hops,
    SQLPath=sql_path,
    TemperatureZoneName=zone_name_for_ot_2,
    CacheResultsInMemory=False,
    CacheSolveResults=False,
    RemoteDefinitionLocation="http://127.0.0.1:5000/temperature",
    RemoteSolveVersion=(0, 1, 0),
    ShowInput_Enabled=True,
    ShowInput_Path=False,
    SynchronousSolve=True)

# ---- group: Out | Thermal Comfort : Hours below 20% PPD as underheated hours. / Uh_1 | Reading json output from Hops
read_json_ot = GhPythonScript(json_string=ot_hops)  # -> out, temperature_data
# ---------- read_json_ot: Python ----------
"""This componenet converts the json string from Hops into data list. 
Hops finds it difficult to send dataframe or list directly via server.
Therefore, it is converted as json and read inside grashopper through this custom python..
    Inputs:
        json_string: Json string returned by Hops componenet
    Output:
        temperature_data: Operative temperatrue of the given zone as list"""

__author__ = "prateekwahi"
__version__ = "2023.10.02"

import json as js

def load_temperature_data(json_string):
    return js.loads(json_string)

temperature_data = load_temperature_data(json_string)
# ---------- end read_json_ot ----------

# ---- group: Out | Thermal Comfort : Hours below 20% PPD as underheated hours. / Uh_2 | Componenet to calculate comfort hours based on Peeters comfort model.
hours_below_20_ppd = GhPythonScript(amot=xdata_2.values, indoor_optemp=read_json_ot.temperature_data, occ=xdata.values)  # -> means, running_mean, average_outdoortemp, neutral_temp, PPD_uplim, PPD_lowlim, htc, htw; inputs amot: list, indoor_optemp: list, occ: list
# ---------- hours_below_20_ppd: Python ----------
"""
This componenet calculates the number of hours that are below 20% PPD for underheated hours. 
The calculations are based on the model of Peeters as described in https://doi.org/10.1016/j.apenergy.2008.07.011. 

Note : This componenet is only limited to living room, kitchen and other spaces. Do not use it for bedrooms or bathrooms. 

    Args:
        amot : Daily outdoor temperature from EPW file. This will be used to calculate hourly outdoor running mean temperature. 
        indoor_optemp : Indoor operative temperature of the room for which comfort is to be calculated. 
        occ : Occupancy of the room as a list of 8760 hours. 
    Return : 
        means : Daily Running Means of outdoor temp for last three days. 
        running_mean : Hourly running mean of outdoor temo for last three days. 
        neutral_temp : Neutral or comfort temperature for the zone. 
        PPD_uplim : 20% PPF upper limit for for overheating. 
        PPD_lowlim : 20% PPD lowerlimit for underheating. 
        htc: number of hours below 20% ppd lower limit (Hours too cold)
        htw : Number of hours above 20% ppd upper limit (Overheating hours). 


"""

__author__ = "SID Drebbelweg"
__version__ = "2023.04.15"

import rhinoscriptsyntax as rs
def running_mean(values):
    n = len(values)
    running_means = [0]*n
    
    for i in range(1,n):
        if i >= 3:
            running_means[i] = (values[i-3]*0.2 + values[i-2]*0.4 + values[i-1]*0.8 + values[i]) / 2.4
    
    return running_means

values = amot
means = running_mean(values)

def hourlyrep(values):
    new = []
    for i in values:
        repeat = [i]*24
        for j in repeat:
            new.append(j)
    return new
    
running_mean = hourlyrep(means)
average_outdoortemp = hourlyrep(amot)

neutral= []
for i in running_mean:
    if i <12.5:
        neut = 20.4+0.06*i
    else:
        neut = 16.63+0.36*i
    neutral.append(neut)

neutral_temp = neutral


PPDuplim = []
for i in neutral_temp:
    uplim = i+(7*0.7)
    PPDuplim.append(uplim)
PPD_uplim = PPDuplim

PPDlowlim = []
for i in neutral_temp:
    lowlim = max(18,i-(7*(1-0.7)))
    PPDlowlim.append(lowlim)
PPD_lowlim = PPDlowlim

ex_lowlim = 0
for (i,j,k) in zip(indoor_optemp,PPD_lowlim, occ):
    if i < j and k == 1:
       ex_lowlim += 1

htc = ex_lowlim

ex_uplim = 0
for (i,j,k) in zip(indoor_optemp,PPD_uplim, occ):
    if i > j and k == 1:
       ex_uplim += 1

htw = ex_uplim
# ---------- end hours_below_20_ppd ----------

# ---- group: Out | Thermal Comfort : Hours below 20% PPD as underheated hours. (continued)
cold_hours = Panel(hours_below_20_ppd.htc)

# ---- group: Out | Reading and writing the outputs
cell_location_in_excel = Panel("N2")
# Step 10  : Write to the output file in the specifed location  or cell numbers.
# 
# Note: Check the path of the file, before writing.
path_to_the_output_excel_file = FilePath(file_path)
cell_location_in_excel_2 = Panel("O2")
occupied_cold_hours_h = Data(graft(hours_below_20_ppd.htc))
xl_out = WriteToExcelClassic(
    WorkbookFilepath=path_to_the_output_excel_file,
    Data=occupied_cold_hours_h,
    LocationAddress=cell_location_in_excel_2,
    Stream=toggle_10)

# ---- group: Samp_1 | Geometry : replace by length cal from CR
# Hops componenet
# 1. run hops_sql_PW
# 2. Server name : http://127.0.0.1:5000
# 3. endpoint for heating : /heating_kwh
# 4. endpoint for coldhours : /temperature
# 5. endpoint for CR : compact_ratio
# 5. right click --> path --> servername/endpoint
# ex: http://127.0.0.1:5000/heating_kwh
compactness_ratio_2 = Panel(compactness_ratio)
cr = Data(flatten(compactness_ratio_2))

# ---- group: Samp_1 | Geometry : replace by length cal from CR / Uh_1 | Hops for cal length of house from sampled CR.
hops = Hops(
    _Enabled=Toggle(True),
    Compact_ratio=cr,
    CacheResultsInMemory=True,
    CacheSolveResults=True,
    RemoteDefinitionLocation="http://127.0.0.1:5000/compact_ratio",
    RemoteSolveVersion=(0, 1, 0),
    ShowInput_Enabled=True,
    ShowInput_Path=False,
    SynchronousSolve=True)

# ---- group: Samp_1 | Geometry : replace by length cal from CR (continued)
expression_2 = Expression(x=hops, Expression="round(x, 2)")

# ---- group: Geo | Scaling Geometry for CR
division_3 = Division(A=expression_2, B=existing_external_length_seed_model)
# Part 2A : Scaling Geometry based on CR
# The geometry is stretched in one direction (Y axis) based on its length.
# The length is determined using a function involving CR and length.
# For each CR from the dataset, L will be calculated.
# A ratio is created between the new length and the original seed length.
# This ratio is then used for scaling purposes.
# 
# Note : expression yet to be made
pt = ConstructPoint(XCoordinate=0, YCoordinate=0, ZCoordinate=0)
scale_nu = ScaleNU(Geometry=archtype_seed_geometry, Plane=pt, ScaleX=1, ScaleY=division_3, ScaleZ=1)  # -> Geometry, Transform

# ---- group: Geo | Geometry intersection for adjancy test / Lbhb_1
intsolid = HBIntersectSolids(rooms=flatten(scale_nu.Geometry), run=toggle_12)  # -> graft(int_rooms); plug-in component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

# ---- group: Geo | Geometry intersection for adjancy test / Uh_1
bang_2 = ExplodeTree(Data=intsolid)  # -> Branch0, Branch1, Branch2, Branch3, Branch4, Branch5, Branch6, Branch7

# ---- group: Lbhb | Honeybee geometry / Lbhb_1 | Rhino geo to HB geo
# Part 2B : Rhino Geometry --> HB Geometry
# The rhino geometry is converted to honeybee geometry for simulations.
# Also specifing if the spaces are conditioned or not.
conditioned_space = BooleanToggle(False)
roomsolid = HBRoomFromSolid(geo=flatten(bang_2.Branch0), name="Roof", conditioned=conditioned_space)  # -> report, rooms; plug-in component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
roomsolid_2 = HBRoomFromSolid(geo=flatten(bang_2.Branch1), name="Kitchen", conditioned=True)  # -> report, rooms; plug-in component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
roomsolid_3 = HBRoomFromSolid(geo=flatten(bang_2.Branch2), name="Unheated Space GF", conditioned=conditioned_space)  # -> report, rooms; plug-in component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
roomsolid_4 = HBRoomFromSolid(geo=flatten(bang_2.Branch3), name="Living Room", conditioned=True)  # -> report, rooms; plug-in component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
roomsolid_5 = HBRoomFromSolid(geo=flatten(bang_2.Branch4), name="Bedroom North", conditioned=True)  # -> report, rooms; plug-in component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
roomsolid_6 = HBRoomFromSolid(geo=flatten(bang_2.Branch5), name="Bedroom South", conditioned=True)  # -> report, rooms; plug-in component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
roomsolid_7 = HBRoomFromSolid(geo=flatten(bang_2.Branch6), name="Bathroom", conditioned=conditioned_space)  # -> report, rooms; plug-in component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
roomsolid_8 = HBRoomFromSolid(geo=flatten(bang_2.Branch7), name="Unheated space ff", conditioned=conditioned_space)  # -> report, rooms; plug-in component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

# ---- group: Lbhb | Honeybee geometry / Lbhb_1 | Honeybee rooms
bedroom_north = Data(roomsolid_5.rooms)
bedrooms_south = Data(roomsolid_6.rooms)
unheated_space_ff = Data(roomsolid_8.rooms)
kitchen = Data(roomsolid_2.rooms)
living_room = Data(roomsolid_4.rooms)
unheated_space_gf = Data(roomsolid_3.rooms)
roof = Data(roomsolid.rooms)
bathrooms = Data(roomsolid_7.rooms)

# ---- group: Lbhb / Lbhb_1 | Adj_1
# 3A: Solving adjancies for intermediate position
# Adj 1 : Solves the adjacenies between living room and kitchen. In original plan the living room and
# kitchen is one open space. However, we wish to study only living room for thermal comfort.
# Therefore, a air wall is made between them.
solveadj = HBSolveAdjacency(rooms=flatten([kitchen, living_room]), air_boundary=toggle_13, run=toggle_13)  # -> report, adj_rooms; plug-in component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

# ---- group: Lbhb / Lbhb_1 | Adj_2
# Adj 2: Solves adjancies between
# living room, kitchen and
# unheated spaces on ground floor.
solveadj_2 = HBSolveAdjacency(rooms=flatten([unheated_space_gf, solveadj.adj_rooms]), run=toggle_14)  # -> report, adj_rooms; plug-in component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

# ---- group: Lbhb / Lbhb_1 | Adj_3
# Adj 3: Solves adjancies between
# ground floor, first floor and roof.
solveadj_3 = HBSolveAdjacency(rooms=flatten([roof, bedroom_north, bedrooms_south, bathrooms, unheated_space_ff, solveadj_2.adj_rooms]), run=toggle_15)  # -> report, adj_rooms; plug-in component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

# ---- group: Lbhb
# Specifing sepration walls to be adiabatic
# for intermediate position
# of the terraced houses.
# Setting external walls on east
# and west as adiabtic.
adiabaticbytype = HBAdiabaticByType(hb_objs=flatten(solveadj_3.adj_rooms), exterior_walls=bool_for_adiabatic_external_surface)  # -> hb_objs; plug-in component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

# ---- group: Lbhb / Out_1 | Honeybee objects solved boundry conditions
hb_objs = Data(adiabaticbytype)

# ---- group: Lbhb | Honey geometry zone wise with solved adj / Inp_1 | adj solved rooms
hb_room_objects = Data(hb_objs)

# ---- group: Lbhb | Honey geometry zone wise with solved adj / Uh_1 | Exploding all hb rooms into streams
bang_3 = ExplodeTree(Data=graft(hb_room_objects))  # -> Branch0, Branch1, Branch2, Branch3, Branch4, Branch5, Branch6, Branch7

# ---- group: Lbhb | Honey geometry zone wise with solved adj / Lbhb_1 | Rooms with solved adjacenies
unheated_space_ff_2 = Data(bang_3.Branch4)
kitchen_2 = Data(bang_3.Branch6)
living_room_2 = Data(bang_3.Branch7)
roof_2 = Data(bang_3.Branch0)
bedroom_south = Data(bang_3.Branch2)
bathroom = Data(bang_3.Branch3)
unheated_space_gf_2 = Data(bang_3.Branch5)
bedroom_north_2 = Data(bang_3.Branch1)

# ---- group: Uh | Calculating compactness ratio / Inp | Solved adjacencies
hb_room_objects_2 = Data(hb_objs)

# ---- group: Uh | Calculating compactness ratio / Uh_1 | Cal. Heat loss area / Lbhb_1
facesbybc = HBFacesByBC(hb_objs=hb_room_objects_2)  # -> outdoors, surface, ground, adiabatic, other; plug-in component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

# ---- group: Samp_1 | WWR from sampling
wwr_bedrooms_seed_model = Panel("0.32")
wwr_kitchen_seed_model = Panel("0.29")
wwr_bedroom_seed_model = Panel("0.61")
sample_wwr = Data(wwr)
seed_model_wwr = Data(wwr_of_seed_model)
wwr_skylight_seed_model = Panel("0.02")

# ----
expression_3 = Expression(x=sample_wwr, Expression="x/100")

# ---- group: Samp_1 | WWR from sampling (continued)
scale_wwr = GhPythonScript(
    Sample_WWR=expression_3,
    Seed_Model_WWR=seed_model_wwr,
    Sky_seed_WWR=wwr_skylight_seed_model,
    Bedroom_seed_WWR=wwr_bedrooms_seed_model,
    Kitchen_seed_WWR=wwr_kitchen_seed_model,
    Living_room_seed_WWR=wwr_bedroom_seed_model)  # -> WWR_Sky, WWR_Bedrooms, WWR_Kitchen, WWR_Living_room
# ---------- scale_wwr: Python ----------
"""This component scales the window to all ratio of individual room to fit the window to wall ratio of the entire dwelling.
This is done because the WWR of the individual rooms are not propotional to the overall dwellling. 
    Inputs:
        Sample_WWR: The WWR ratio recived from sampling.
        Seed_Model_WWR :  The WWR of the entire seed model. 
        Sky_seed_WWR: The WWR ratio of skylights in roof as per the seed model.
        Bedroom_seed_WWR: The WWR ratio of bedrooms as per the seed model.
        Kitchen_seed_WWR : The WWR ratio of kitchen as per the seed model.
        Living_room_seed_WWR : The WWR ratio of living_room as per the seed model.
    Output:
        WWR_Sky: Scaled WWR of the skylghts in roof
        WWR_Bedrooms : Scaled WWR of bedrooms
        WWR_Kitchen : Scaled WWR of kitchen
        WWR_Living_room : Scaled WWR of the living room"""

__author__ = "prateekwahi"
__version__ = "2023.10.18"

import rhinoscriptsyntax as rs
import math
Scaling_factor = (Sample_WWR / Seed_Model_WWR)

WWR_Sky = Sky_seed_WWR * Scaling_factor
WWR_Bedrooms = Bedroom_seed_WWR * Scaling_factor
WWR_Kitchen = Kitchen_seed_WWR * Scaling_factor
WWR_Living_room = Living_room_seed_WWR * Scaling_factor
# ---------- end scale_wwr ----------

# ---- group: Lbhb | Model with windows, openings and ventilation / Inp_1 | WWR from sampling
wwr_sky = Data(scale_wwr.WWR_Sky)

wwr_kit = Data(scale_wwr.WWR_Kitchen)

wwr_liv = Data(scale_wwr.WWR_Living_room)

wwr_bed = Data(scale_wwr.WWR_Bedrooms)

# ---- group: Lbhb | Model with windows, openings and ventilation
skylightsbyratio = HBSkylightsByRatio(hb_objs=flatten(roof_2), ratio=wwr_sky)  # -> report, hb_objs; plug-in component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
window_opening = GhPythonScript(vent_sys=ventilation_system)  # -> out, window_op; inputs vent_sys: Int32
# ---------- window_opening: Python ----------
"""
Controls the opening or closing of the windows based on the sampling. 
The windows will only be openend for natural ventilation. 
-

    Args:
        vent_sys: Type of ventilation system. This input must come from sampling. 
        1 --> System A: Natural Ventilation 
        2 --> System B: Mechanical intake and natural exhaust. 
        3 --> System C1: Natural intake and Mecanical exhaust (no control)
        4 --> System C3c : Type of system C
        5 --> System C3a : Type of system C.
        6 --> System D1 : Mechanical supply and exhaust (balanced)
        7 --> System D5 : Decentralsied with CO2 and HR. 

    Returns:
        window_op : Window operation 
        1 --> Window open 
        0 --> Window close
"""

__author__ = "prateekwahi"
__version__ = "2023.09.13"

import rhinoscriptsyntax as rs
if vent_sys == 1:
    window_op = 1
else:
    window_op = 0
# ---------- end window_opening ----------
door_3 = HBDoor(geo=door)  # -> report, doors; plug-in component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
ventcontrol = HBVentilationControl(min_out_temp="20")  # -> vent_cntrl; plug-in component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
ventcontrol_2 = HBVentilationControl(min_out_temp="10")  # -> vent_cntrl; plug-in component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
addsubface = HBAddSubface(hb_obj=flatten(unheated_space_gf_2), sub_faces=flatten(door_3.doors))  # -> hb_obj; plug-in component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

# ---- group: Lbhb | Model with windows, openings and ventilation / Bol | window open Y/N ?
window_open_bool = Boolean(window_opening.window_op)

# ---- group: Lbhb | Model with windows, openings and ventilation (continued)
aperturesbyratio = HBAperturesByRatio(hb_objs=flatten(kitchen_2), ratio=wwr_kit, subdivide=False, operable=window_open_bool)  # -> report, hb_objs; plug-in component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
aperturesbyratio_2 = HBAperturesByRatio(hb_objs=flatten(living_room_2), ratio=wwr_liv, subdivide=False, operable=window_open_bool)  # -> report, hb_objs; plug-in component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
aperturesbyratio_3 = HBAperturesByRatio(hb_objs=flatten([bedroom_south, bedroom_north_2]), ratio=wwr_bed, subdivide=False, operable=window_open_bool)  # -> report, hb_objs; plug-in component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
windowopen = HBWindowOpening(rooms=flatten(aperturesbyratio.hb_objs), vent_cntrl=ventcontrol_2, fract_area_oper="0.3")  # -> report, rooms; plug-in component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
windowopen_2 = HBWindowOpening(rooms=flatten(aperturesbyratio_2.hb_objs), vent_cntrl=ventcontrol_2, fract_area_oper="0.3")  # -> report, rooms; plug-in component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
windowopen_3 = HBWindowOpening(rooms=flatten(aperturesbyratio_3.hb_objs), vent_cntrl=ventcontrol, fract_area_oper="0.8")  # -> report, rooms; plug-in component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

# ----
entwine_2 = Entwine(
    Branch00=aperturesbyratio.hb_objs,
    Branch01=addsubface,
    Branch02=aperturesbyratio_2.hb_objs,
    Branch03=aperturesbyratio_3.hb_objs,
    Branch04=skylightsbyratio.hb_objs,
    Branch05=bathroom,
    Branch06=unheated_space_ff_2,
    FlattenInputs=True)
entwine_3 = Entwine(
    Branch00=windowopen.rooms,
    Branch01=addsubface,
    Branch02=windowopen_2.rooms,
    Branch03=windowopen_3.rooms,
    Branch04=skylightsbyratio.hb_objs,
    Branch05=bathroom,
    Branch06=unheated_space_ff_2,
    FlattenInputs=True)

# ---- group: Lbhb | Model with windows, openings and ventilation / Out_1 | Seed model for other vent systems.
seed_model__vent_systems = Data(flatten(entwine_2))

# ---- group: Lbhb | Model with windows, openings and ventilation / Out_1 | Seed model with natural vent
seed_model_with_natural_vent = Data(flatten(entwine_3))

# ---- group: Lbhb | Model with windows, openings and ventilation / Out | Seed Model based on vent type.
filter = StreamFilter(Gate=window_opening.window_op, Stream0=seed_model__vent_systems, Stream1=seed_model_with_natural_vent)

# ---- group: Out | Seed model with opening and ventilation
seed_model_with_openings = Data(filter)

# ---- group: Lbhb | building envelope properties through R values. / inp_1 | seed model with openings
seed_model_openings = Data(flatten(seed_model_with_openings))

# ---- group: Lbhb | building envelope properties through R values. / Lbhb_1 | Construction sets and subsets
interiorsubset = HBInteriorConstructionSubset(interior_wall=opaqueconstr_5, ceiling=opaqueconstr_6, interior_floor=opaqueconstr_6)  # -> interior_set; plug-in component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
subfacesubset = HBSubfaceSubset(window=windowconstr, skylight=windowconstr, exterior_door=opaqueconstr_4)  # -> subface_set; plug-in component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
exteriorsubset = HBExteriorConstructionSubset(exterior_wall=opaqueconstr_3, exterior_roof=opaqueconstr_2)  # -> exterior_set; plug-in component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
groundsubset = HBGroundConstructionSubset(ground_floor=opaqueconstr)  # -> ground_set; plug-in component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
constructionset = HBConstructionSet(exterior_subset=exteriorsubset, ground_subset=groundsubset, interior_subset=interiorsubset, subface_subset=subfacesubset)  # -> constr_set; plug-in component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
applyconstrset = HBApplyConstructionSet(rooms=seed_model_openings, constr_set=constructionset)  # -> rooms; plug-in component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

# ---- group: Out | seed model with const/insul.
seed_model_const_insu = Data(flatten(applyconstrset))

# ---- group: Uh | Calculating compactness ratio / Inp_1 | Seed model with construction
# 4B: Calculating compactness ratio
# The CR is calculted as per NTA8800. Where Ag or GBO is calculted as per section 6.6 of NTA8800.
# Als (heat loss area) is calculted as per section 6.7 of NTA8800
seed_model_with_const_insu = Data(seed_model_const_insu)

# ---- group: Lbhb | Programme : Schedule, loads and setpoints / Inp_1 | Seed model with cons/infile
# 5: Constructing Typical Building programme
# Building programm constructed using neimans , building decree, researches , ISSO 32, NTA8800, EN16798-1
seed_model_with_const_insu_2 = Data(seed_model_const_insu)

# ---- group: Uh | Calculating compactness ratio
bang_4 = ExplodeTree(Data=graft(seed_model_with_const_insu))  # -> Branch0, Branch1, Branch2, Branch3, Branch4, Branch5, Branch6, Branch7
unheated_space_gf_3 = Data(bang_4.Branch1)
unheated_space_ff_3 = Data(bang_4.Branch7)
bedroom_north_3 = Data(bang_4.Branch3)
bedroom_south_2 = Data(bang_4.Branch4)
living_room_3 = Data(bang_4.Branch2)
bathroom_2 = Data(bang_4.Branch6)
kitchen_3 = Data(bang_4.Branch0)
roof_3 = Data(bang_4.Branch5)
ground_floor_rooms = Data([living_room_3, unheated_space_gf_3, kitchen_3])
first_floor_rooms = Data([bedroom_north_3, unheated_space_ff_3, bedroom_south_2, bathroom_2])
roof_4 = Data(roof_3)

# ---- group: Uh | Calculating compactness ratio / Lbhb_1
geoprop = HBGeometryProperties(rooms=flatten(ground_floor_rooms))  # -> ext_wall_area, ext_win_area, volume, floor_area, floor_ep_constr; plug-in component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

geoprop_2 = HBGeometryProperties(rooms=flatten(roof_4))  # -> ext_wall_area, ext_win_area, volume, floor_area, floor_ep_constr; plug-in component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

geoprop_3 = HBGeometryProperties(rooms=flatten(first_floor_rooms))  # -> ext_wall_area, ext_win_area, volume, floor_area, floor_ep_constr; plug-in component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

# ---- group: Uh | Calculating compactness ratio / Uh_1 | Cal. Ground Floor Area Internal Dim
ma = MassAddition(Input=geoprop.volume)  # -> Result, PartialResults
ma_2 = MassAddition(Input=geoprop.floor_ep_constr)  # -> Result, PartialResults

# ---- group: Uh | Calculating compactness ratio / Uh_1 | Cal. First Floor Area Internal Dim
ma_3 = MassAddition(Input=geoprop_3.volume)  # -> Result, PartialResults
ma_4 = MassAddition(Input=geoprop_3.floor_ep_constr)  # -> Result, PartialResults

# ---- group: Uh | Calculating compactness ratio / Out_1
roof_volume = Number(geoprop_2.volume)
gf_area_internal_dim = Number(ma_2.Result)
ff_area_internal_dim = Number(ma_4.Result)
roof_area_internal_dim = Number(geoprop_2.floor_ep_constr)
roof_area_exetrnal_dim = Number(area_2.Area)
usable_roof_area_exetrnal_dim = Number(area.Area)
gf_volume = Number(ma_2.Result)
gf_volume_2 = Number(ma_3.Result)

# ---- group: Uh | Calculating compactness ratio / Uh_1
subtraction = Subtraction(A=roof_area_exetrnal_dim, B=roof_area_internal_dim)
subtraction_2 = Subtraction(A=usable_roof_area_exetrnal_dim, B=subtraction)
addition = Addition(A=gf_area_internal_dim, B=ff_area_internal_dim, C=subtraction_2)
gbo = Panel(addition)

ma_5 = MassAddition(Input=[gf_volume, gf_volume_2, roof_volume])  # -> Result, PartialResults
volume = Panel(ma_5.Result)

# ---- group: Uh | Calculating compactness ratio / Out_1 | GBO (usable area)
gbo_m2 = Number(gbo)

# ---- group: Out | Volume
volume_m3 = Number(volume)

# ---- group: Out | Space Heating Demand / Uh_1 | extracting Heating demand and recording data
house_gbo_m2 = Data(gbo_m2)
rec = DataRecorder(house_gbo_m2, DataLimit=-10, RecordData=True)

# ----
cull_i = CullIndex(List=rec, Indices="0", Wrap=True)
panel_6 = Panel(cull_i)

# ---- group: Out | Space Heating Demand / Uh_1 | extracting Heating demand and recording data (continued)
division_4 = Division(A=heating_hops, B=cull_i)  # -> flatten(Result)

# ----
panel_7 = Panel(cull_i)
lng_3 = ListLength(List=panel_6)

# ---- group: Out | Space Heating Demand (continued)
sh_demand_kwh_m2 = Panel(division_4)

# ----
panel_8 = Panel(rec)

# ---- group: Out | Reading and writing the outputs (continued)
space_heating_demand_kwh_m2 = Data(graft(division_4))
xl_out_2 = WriteToExcelClassic(
    WorkbookFilepath=path_to_the_output_excel_file,
    Data=space_heating_demand_kwh_m2,
    LocationAddress=cell_location_in_excel,
    Stream=toggle_10)

# ---- group: Uh | Calculating compactness ratio / Uh_1 | Cal. Heat loss area
faceattr = HBFaceAttributes({"Display Name": "display_name", "Simulation Name (Identifier)": "identifier", "Boundary Condition": "boundary_condition", "Has Parent": "has_parent", "Parent": "parent", "Azimuth": "azimuth", "Altitude": "altitude", "Area": "area", "Perimeter": "perimeter", "Face Type": "type", "Aperture Is Operable": "is_operable", "Door Is Glass": "is_glass"}, selected="Area")

# ---- group: Uh | Calculating compactness ratio / Uh_1 | Cal. Heat loss area / Lbhb_1 | Area of external envelope
lablefaces = HBLabelFaces(hb_objs=flatten(facesbybc.outdoors), attribute=faceattr)  # -> label_text, base_pts, labels, wire_frame; plug-in component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

# ---- group: Uh | Calculating compactness ratio / Uh_1 | Cal. Heat loss area / Lbhb_1 | Area of ground floor
lablefaces_2 = HBLabelFaces(hb_objs=flatten(facesbybc.ground), attribute=faceattr)  # -> label_text, base_pts, labels, wire_frame; plug-in component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

# ---- group: Uh | Calculating compactness ratio / Uh_1 | Cal. Heat loss area (continued)
ma_6 = MassAddition(Input=lablefaces.label_text)  # -> Result, PartialResults
ma_7 = MassAddition(Input=lablefaces_2.label_text)  # -> Result, PartialResults

# ---- group: Uh | Calculating compactness ratio / Out_1
area_external_envelope = Number(ma_6.Result)
area_ground_floor = Number(ma_7.Result)

# ---- group: Uh | Calculating compactness ratio / Uh_1 | Expression as per NTA8800
expression_4 = Expression(x=area_ground_floor, y=area_external_envelope, Expression="0.7 * x + y")
loss_area = Panel(expression_4)

# ---- group: Uh | Calculating compactness ratio / Out_1 | Heat loss area
loss_area_m2 = Number(loss_area)

# ---- group: Uh | Calculating compactness ratio (continued)
division_5 = Division(A=loss_area_m2, B=gbo_m2)

# ---- group: Out | Compactness ratio
compactness_ratio_3 = Panel(division_5)

# ---- group: Lbhb | Programme : Schedule, loads and setpoints
set_back_bedroom__1975 = Data(weeklyschedule_20.schedule)
set_back_bedroom__1975_2 = Data(weeklyschedule_21.schedule)
set_pt_livingarea__1975 = Data(weeklyschedule_17.schedule)
set_pt_livingarea__1975_2 = Data(weeklyschedule_22.schedule)
bang_5 = ExplodeTree(Data=graft(seed_model_with_const_insu_2))  # -> Branch0, Branch1, Branch2, Branch3, Branch4, Branch5, Branch6, Branch7
setpt_livingarea_sample21_19 = Data(weeklyschedule_12.schedule)
setbk_bedroom_sample20_18 = Data(weeklyschedule_13.schedule)
setbk_bedroom_sample21_19 = Data(weeklyschedule_11.schedule)
setpt_livingarea_sample18_16 = Data(weeklyschedule_16.schedule)
setbk_bedroom_sample18_16 = Data(weeklyschedule_15.schedule)
setpt_livingarea_sample20_18 = Data(weeklyschedule_14.schedule)
setpoint_sample = GhPythonScript(Temp_set=temp_setpoint_sample)  # -> out, setpt_index
# ---------- setpoint_sample: Python ----------
__author__ = "prateekwahi"
__version__ = "2023.10.21"

import rhinoscriptsyntax as rs
if Temp_set == 18:
    filter_index = 0
elif Temp_set == 19:
    filter_index = 1
elif Temp_set == 20:
    filter_index = 2
elif Temp_set == 21:
    filter_index = 3
# These two is only added for testing calibration.
# These two sets will not be sampled. 
# Tempset for house built before 1975 as per Neiman, 2021
elif Temp_set == 16:    
    filter_index = 4
# 200 to avoid the 20 temp set above 
# Tempset for house built after 1975 as per Neiman, 2021
elif Temp_set == 200: 
    filter_index = 5
    
setpt_index = filter_index
# ---------- end setpoint_sample ----------
setpt_livingarea_sample19_17 = Data(weeklyschedule_19.schedule)
setbk_bedroom_sample19_17 = Data(weeklyschedule_18.schedule)
filter_2 = StreamFilter(
    Gate=setpoint_sample.setpt_index,
    Stream0=setpt_livingarea_sample18_16,
    Stream1=setpt_livingarea_sample19_17,
    Stream2=setpt_livingarea_sample20_18,
    Stream3=setpt_livingarea_sample21_19,
    Stream4=set_pt_livingarea__1975,
    Stream5=set_pt_livingarea__1975_2)
filter_3 = StreamFilter(
    Gate=setpoint_sample.setpt_index,
    Stream0=setbk_bedroom_sample18_16,
    Stream1=setbk_bedroom_sample19_17,
    Stream2=setbk_bedroom_sample20_18,
    Stream3=setbk_bedroom_sample21_19,
    Stream4=set_back_bedroom__1975_2,
    Stream5=set_back_bedroom__1975)
convert_dm3_s_to_m3_s_3 = Panel("1000")
convert_dm3_s_to_m3_s_4 = Panel("1000")

# ---- group: Lbhb | Programme : Schedule, loads and setpoints / Inp_1 | Schedules and setpoints
set_pt_living_area = Data(filter_2)
cooling_schedule = Data(constantschedule.schedule)
gains_light_equip_occ_sch = Data(weeklyschedule_10.schedule)
setpt_niemen_living = Data(set_pt_living_area)
setpt_niemen_kitchen = Data(set_pt_living_area)
setpt_niemen_bedrooms = Data(filter_3)

# ---- group: Lbhb | Programme : Schedule, loads and setpoints / Inp_1 | Thermal zones with insulation properties
kitchen_4 = Data(bang_5.Branch0)
unheated_space_gf_4 = Data(bang_5.Branch1)
living_room_4 = Data(bang_5.Branch2)
bedroom_north_4 = Data(bang_5.Branch3)
bedroom_south_3 = Data(bang_5.Branch4)
roof_5 = Data(bang_5.Branch5)
bathroom_3 = Data(bang_5.Branch6)
unheated_space_ff_4 = Data(bang_5.Branch7)

# ---- group: Lbhb | Programme : Schedule, loads and setpoints / Lbhb_1 | unheate spaces on GF and FF with internal loads / Inp_2 | HBobj fixed infil & vent
hb_unheated_spaces = Data([unheated_space_gf_4, unheated_space_ff_4])

# ---- group: Lbhb | Programme : Schedule, loads and setpoints / Inp_2 | Sch
min_vent_rate_circulation_dm3_s_per_m2_b = Panel("0.15")  # "min Vent rate (circulation) dm3/s per m2 , BBS"
occupants_sch = Data(gains_light_equip_occ_sch)
fixed_light_loads = Data(fixed_light_loads_for_dwelling_w_m2)
light_sch = Data(gains_light_equip_occ_sch)
fixed_equip_loads = Data(fixed_equipment_loads_for_dwelling_w_m2)
equipment_sch = Data(gains_light_equip_occ_sch)
infil_rate = Data(expression)

# ---- group: Lbhb | Programme : Schedule, loads and setpoints / Lbhb_1 | Internal Loads Liv room / Inp_2 | HBobj fixed infil & vent
hb_living_room = Data(living_room_4)

# ---- group: Lbhb | Programme : Schedule, loads and setpoints / Inp_2 Sch and Lds
light_sch_2 = Data(gains_light_equip_occ_sch)
infil_rate_2 = Data(expression)
cooling_sch = Data(cooling_schedule)
occupant_sch = Data(gains_light_equip_occ_sch)
fixed_light_loads_2 = Data(fixed_light_loads_for_dwelling_w_m2)
fixed_equip_loads_2 = Data(fixed_equipment_loads_for_dwelling_w_m2)
equipment_sch_2 = Data(gains_light_equip_occ_sch)
heating_sch = Data(setpt_niemen_living)

# ---- group: Lbhb | Programme : Schedule, loads and setpoints / Lbhb_1 | Internal Loads Kitchen / Inp_2 | HBobj fixed infil & vent
hb_kitchen = Data(kitchen_4)

# ---- group: Lbhb | Programme : Schedule, loads and setpoints / Inp_2 | Sch
infil_rate_3 = Data(expression)
min_vent_rate_kitchen_dm3_s_per_m2_bbs = Panel("21")
cooling_sch_2 = Data(cooling_schedule)
occupant_sch_2 = Data(gains_light_equip_occ_sch)
heating_sch_2 = Data(setpt_niemen_kitchen)

# ---- group: Lbhb | Programme : Schedule, loads and setpoints / Lbhb_1 | Bedrooms with internal loads / Inp_2 | HBobj fixed infil & vent
hb_bedrooms = Data([bedroom_north_4, bedroom_south_3])

# ---- group: Lbhb | Programme : Schedule, loads and setpoints / Inp_2 | Sch and Lds
occupant_sch_3 = Data(gains_light_equip_occ_sch)
light_sch_3 = Data(gains_light_equip_occ_sch)
fixed_light_loads_3 = Data(fixed_light_loads_for_dwelling_w_m2)
equipment_sch_3 = Data(gains_light_equip_occ_sch)
cooling_schedule_2 = Data(cooling_schedule)
fixed_equip_loads_3 = Data(fixed_equipment_loads_for_dwelling_w_m2)
heating_sch_3 = Data(setpt_niemen_bedrooms)

# ---- group: Lbhb | Programme : Schedule, loads and setpoints / Lbhb_1 | Bathroom with internal loads / Inp_2 | HBobj fixed infil & vent
hb_bathroom = Data(bathroom_3)

# ---- group: Lbhb | Programme : Schedule, loads and setpoints / Inp_2 | Sch and Lds
occupants_sch_2 = Data(gains_light_equip_occ_sch)
min_vent_rate_bathroom_dm3_s_per_m2_bbs = Panel("14")
infil_rate_4 = Data(expression)

# ---- group: Lbhb | Programme : Schedule, loads and setpoints / Lbhb_1 | Attic with internal loads / Inp_2 | HBobj fixed infil & vent
hb_attic = Data(roof_5)

# ---- group: Lbhb | Programme : Schedule, loads and setpoints / Inp_2 | sch and lds
attic_gbo = Data(subtraction_2)
occupants_sch_3 = Data(gains_light_equip_occ_sch)
infil_rate_5 = Data(expression)

# ---- group: Lbhb | Programme : Schedule, loads and setpoints / Lbhb_1 | unheate spaces on GF and FF with internal loads
geoprop_4 = HBGeometryProperties(rooms=flatten(hb_unheated_spaces))  # -> ext_wall_area, ext_win_area, volume, floor_area, floor_ep_constr; plug-in component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
convert_dm3_s_to_m3_s_5 = Panel("1000")
ma_8 = MassAddition(Input=geoprop_4.floor_ep_constr)  # -> Result, PartialResults
panel_9 = Panel("Unheated spaces GF and FF")
division_6 = Division(A=num_occ, B=ma_8.Result)
division_7 = Division(A=min_vent_rate_circulation_dm3_s_per_m2_b, B=convert_dm3_s_to_m3_s_5)
people = HBPeople(name=panel_9, ppl_per_area=division_6, occupancy_sch=occupants_sch)  # -> people; plug-in component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
lighting = HBLighting(name=panel_9, watts_per_area=fixed_light_loads, schedule=light_sch)  # -> lighting; plug-in component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
equipment = HBEquipment(name=panel_9, watts_per_area=fixed_equip_loads, schedule=equipment_sch)  # -> equip; plug-in component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
infiltration = HBInfiltration(name=panel_9, flow_per_ext_area=infil_rate)  # -> infil; plug-in component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
ventilation = HBVentilation(name=panel_9, flow_per_area=division_7)  # -> vent; plug-in component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
bldgprograms = HBBuildingPrograms({"LargeOffice", "MediumOffice", "SmallOffice", "MidriseApartment", "HighriseApartment", "Retail", "StripMall", "PrimarySchool", "SecondarySchool", "SmallHotel", "LargeHotel", "Hospital", "Outpatient", "Laboratory", "Warehouse", "SuperMarket", "FullServiceRestaurant", "QuickServiceRestaurant", "Courthouse", "LargeDataCenterHighITE", "LargeDataCenterLowITE", "SmallDataCenterHighITE", "SmallDataCenterLowITE"}, selected="MidriseApartment")
programtype = HBProgramType(
    name=panel_9,
    base_program=bldgprograms,
    people=people,
    lighting=lighting,
    electric_equip=equipment,
    infiltration=infiltration,
    ventilation=ventilation)  # -> program; plug-in component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
applyprogram = HBApplyProgramType(rooms=flatten(hb_unheated_spaces), program=programtype)  # -> report, rooms; plug-in component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

# ---- group: Lbhb | Programme : Schedule, loads and setpoints / Lbhb_1 | Attic with internal loads
division_8 = Division(A=num_occ, B=attic_gbo)
people_2 = HBPeople(name="Attic", ppl_per_area=division_8, occupancy_sch=occupants_sch_3)  # -> people; plug-in component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
infiltration_2 = HBInfiltration(flow_per_ext_area=infil_rate_5)  # -> infil; plug-in component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
bldgprograms_2 = HBBuildingPrograms({"LargeOffice", "MediumOffice", "SmallOffice", "MidriseApartment", "HighriseApartment", "Retail", "StripMall", "PrimarySchool", "SecondarySchool", "SmallHotel", "LargeHotel", "Hospital", "Outpatient", "Laboratory", "Warehouse", "SuperMarket", "FullServiceRestaurant", "QuickServiceRestaurant", "Courthouse", "LargeDataCenterHighITE", "LargeDataCenterLowITE", "SmallDataCenterHighITE", "SmallDataCenterLowITE"}, selected="MidriseApartment")
programtype_2 = HBProgramType(
    name="Attic",
    base_program=bldgprograms_2,
    people=people_2,
    lighting=lighting,
    electric_equip=equipment,
    infiltration=infiltration_2)  # -> program; plug-in component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
applyprogram_2 = HBApplyProgramType(rooms=flatten(hb_attic), program=programtype_2)  # -> report, rooms; plug-in component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

# ---- group: Lbhb | Programme : Schedule, loads and setpoints / Lbhb_1 | unheate spaces on GF and FF with internal loads / Out_1 | unheated spaces with internal laods
unheated_spaces_loads = Data(applyprogram.rooms)

# ---- group: Lbhb | Programme : Schedule, loads and setpoints / Lbhb_1 | Attic with internal loads / Out_1 | Attic with internal laods
# CHECK OUT CONFIGURATION
atticloads = Data(applyprogram_2.rooms)

# ---- group: Lbhb | Programme : Schedule, loads and setpoints / Lbhb_1 | Bedrooms with internal loads
infil_rate_6 = Data(expression)
geoprop_5 = HBGeometryProperties(rooms=flatten(hb_bedrooms))  # -> ext_wall_area, ext_win_area, volume, floor_area, floor_ep_constr; plug-in component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
ma_9 = MassAddition(Input=geoprop_5.floor_ep_constr)  # -> Result, PartialResults
division_9 = Division(A=num_occ, B=ma_9.Result)
gate = StreamGate(Stream=occupant_sch_3, Gate=vent_helper_2.DDV_sch)  # -> Target0, Target1
panel_10 = Panel("Bedrooms")
people_3 = HBPeople(name=panel_10, ppl_per_area=division_9, occupancy_sch=occupant_sch_3)  # -> people; plug-in component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
lighting_2 = HBLighting(name=panel_10, watts_per_area=fixed_light_loads_3, schedule=light_sch_3)  # -> lighting; plug-in component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
equipment_2 = HBEquipment(name=panel_10, watts_per_area=fixed_equip_loads_3, schedule=equipment_sch_3)  # -> equip; plug-in component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
setpoint = HBSetpoint(name=panel_10, heating_sch=heating_sch_3, cooling_sch=cooling_schedule_2)  # -> setpoint; plug-in component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
bldgprograms_3 = HBBuildingPrograms({"LargeOffice", "MediumOffice", "SmallOffice", "MidriseApartment", "HighriseApartment", "Retail", "StripMall", "PrimarySchool", "SecondarySchool", "SmallHotel", "LargeHotel", "Hospital", "Outpatient", "Laboratory", "Warehouse", "SuperMarket", "FullServiceRestaurant", "QuickServiceRestaurant", "Courthouse", "LargeDataCenterHighITE", "LargeDataCenterLowITE", "SmallDataCenterHighITE", "SmallDataCenterLowITE"}, selected="MidriseApartment")

# ---- group: Lbhb | Programme : Schedule, loads and setpoints / Lbhb_1 | Internal Loads Liv room
geoprop_6 = HBGeometryProperties(rooms=flatten(hb_living_room))  # -> ext_wall_area, ext_win_area, volume, floor_area, floor_ep_constr; plug-in component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
division_10 = Division(A=num_occ, B=geoprop_6.floor_ep_constr)
panel_11 = Panel("Living Room")
people_4 = HBPeople(name=panel_11, ppl_per_area=division_10, occupancy_sch=occupant_sch)  # -> people; plug-in component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
lighting_3 = HBLighting(name=panel_11, watts_per_area=fixed_light_loads_2, schedule=light_sch_2)  # -> lighting; plug-in component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
equipment_3 = HBEquipment(name=panel_11, watts_per_area=fixed_equip_loads_2, schedule=equipment_sch_2)  # -> equip; plug-in component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
infiltration_3 = HBInfiltration(name=panel_11, flow_per_ext_area=infil_rate_2)  # -> infil; plug-in component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
setpoint_2 = HBSetpoint(name=panel_11, heating_sch=heating_sch, cooling_sch=cooling_sch)  # -> setpoint; plug-in component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
bldgprograms_4 = HBBuildingPrograms({"LargeOffice", "MediumOffice", "SmallOffice", "MidriseApartment", "HighriseApartment", "Retail", "StripMall", "PrimarySchool", "SecondarySchool", "SmallHotel", "LargeHotel", "Hospital", "Outpatient", "Laboratory", "Warehouse", "SuperMarket", "FullServiceRestaurant", "QuickServiceRestaurant", "Courthouse", "LargeDataCenterHighITE", "LargeDataCenterLowITE", "SmallDataCenterHighITE", "SmallDataCenterLowITE"}, selected="MidriseApartment")

# ---- group: Lbhb | Programme : Schedule, loads and setpoints / Lbhb_1 | Internal Loads Kitchen
geoprop_7 = HBGeometryProperties(rooms=flatten(hb_kitchen))  # -> ext_wall_area, ext_win_area, volume, floor_area, floor_ep_constr; plug-in component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
division_11 = Division(A=num_occ, B=geoprop_7.floor_ep_constr)
division_12 = Division(A=min_vent_rate_kitchen_dm3_s_per_m2_bbs, B=convert_dm3_s_to_m3_s_3)
people_5 = HBPeople(name="Kitchen", ppl_per_area=division_11, occupancy_sch=occupant_sch_2)  # -> people; plug-in component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
infiltration_4 = HBInfiltration(name="Kitchen", flow_per_ext_area=infil_rate_3)  # -> infil; plug-in component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
ventilation_2 = HBVentilation(name="Kitchen", flow_per_zone=division_12)  # -> vent; plug-in component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
setpoint_3 = HBSetpoint(name="Kitchen", heating_sch=heating_sch_2, cooling_sch=cooling_sch_2)  # -> setpoint; plug-in component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
bldgprograms_5 = HBBuildingPrograms({"LargeOffice", "MediumOffice", "SmallOffice", "MidriseApartment", "HighriseApartment", "Retail", "StripMall", "PrimarySchool", "SecondarySchool", "SmallHotel", "LargeHotel", "Hospital", "Outpatient", "Laboratory", "Warehouse", "SuperMarket", "FullServiceRestaurant", "QuickServiceRestaurant", "Courthouse", "LargeDataCenterHighITE", "LargeDataCenterLowITE", "SmallDataCenterHighITE", "SmallDataCenterLowITE"}, selected="MidriseApartment")
programtype_3 = HBProgramType(
    name="Kitchen",
    base_program=bldgprograms_5,
    people=people_5,
    lighting=lighting_3,
    electric_equip=equipment_3,
    infiltration=infiltration_4,
    ventilation=ventilation_2,
    setpoint=setpoint_3)  # -> program; plug-in component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
applyprogram_3 = HBApplyProgramType(rooms=flatten(hb_kitchen), program=programtype_3)  # -> report, rooms; plug-in component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

# ---- group: Lbhb | Programme : Schedule, loads and setpoints / Lbhb_1 | Internal Loads Kitchen / Out_1 | Kitchen with internal laods
kitchen_with_loads = Data(applyprogram_3.rooms)

# ---- group: Lbhb | Programme : Schedule, loads and setpoints / Lbhb_1 | Bathroom with internal loads
geoprop_8 = HBGeometryProperties(rooms=flatten(hb_bathroom))  # -> ext_wall_area, ext_win_area, volume, floor_area, floor_ep_constr; plug-in component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
panel_12 = Panel("Bathroom")
division_13 = Division(A=num_occ, B=geoprop_8.floor_ep_constr)
people_6 = HBPeople(name=panel_12, ppl_per_area=division_13, occupancy_sch=occupants_sch_2)  # -> people; plug-in component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
bldgprograms_6 = HBBuildingPrograms({"LargeOffice", "MediumOffice", "SmallOffice", "MidriseApartment", "HighriseApartment", "Retail", "StripMall", "PrimarySchool", "SecondarySchool", "SmallHotel", "LargeHotel", "Hospital", "Outpatient", "Laboratory", "Warehouse", "SuperMarket", "FullServiceRestaurant", "QuickServiceRestaurant", "Courthouse", "LargeDataCenterHighITE", "LargeDataCenterLowITE", "SmallDataCenterHighITE", "SmallDataCenterLowITE"}, selected="MidriseApartment")

# ---- group: Lbhb | Programme : Schedule, loads and setpoints (continued)
gate_2 = StreamGate(Stream=occupant_sch, Gate=vent_helper.DDV_sch)  # -> Target0, Target1
division_14 = Division(A=min_vent_rate_bathroom_dm3_s_per_m2_bbs, B=convert_dm3_s_to_m3_s_4)
ventilation_3 = HBVentilation(name=panel_11, flow_per_area=division, schedule=gate_2.Target1)  # -> vent; plug-in component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
infiltration_5 = HBInfiltration(name=panel_10, flow_per_ext_area=infil_rate_6)  # -> infil; plug-in component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
ventilation_4 = HBVentilation(name=panel_10, flow_per_area=division_2, schedule=gate.Target1)  # -> vent; plug-in component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
infiltration_6 = HBInfiltration(name=panel_12, flow_per_ext_area=infil_rate_4)  # -> infil; plug-in component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

# ---- group: Lbhb | Programme : Schedule, loads and setpoints / Lbhb_1 | Bathroom with internal loads (continued)
ventilation_5 = HBVentilation(name=panel_12, flow_per_zone=division_14)  # -> vent; plug-in component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
programtype_4 = HBProgramType(
    name=panel_12,
    base_program=bldgprograms_6,
    people=people_6,
    lighting=lighting,
    electric_equip=equipment,
    infiltration=infiltration_6,
    ventilation=ventilation_5)  # -> program; plug-in component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
applyprogram_4 = HBApplyProgramType(rooms=flatten(hb_bathroom), program=programtype_4)  # -> report, rooms; plug-in component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

# ---- group: Lbhb | Programme : Schedule, loads and setpoints / Lbhb_1 | Bedrooms with internal loads (continued)
programtype_5 = HBProgramType(
    name=panel_10,
    base_program=bldgprograms_3,
    people=people_3,
    lighting=lighting_2,
    electric_equip=equipment_2,
    infiltration=infiltration_5,
    ventilation=ventilation_4,
    setpoint=setpoint)  # -> program; plug-in component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
applyprogram_5 = HBApplyProgramType(rooms=flatten(hb_bedrooms), program=programtype_5)  # -> report, rooms; plug-in component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

# ---- group: Lbhb | Programme : Schedule, loads and setpoints / Lbhb_1 | Internal Loads Liv room (continued)
programtype_6 = HBProgramType(
    name=panel_11,
    base_program=bldgprograms_4,
    people=people_4,
    lighting=lighting_3,
    electric_equip=equipment_3,
    infiltration=infiltration_3,
    ventilation=ventilation_3,
    setpoint=setpoint_2)  # -> program; plug-in component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
applyprogram_6 = HBApplyProgramType(rooms=flatten(hb_living_room), program=programtype_6)  # -> report, rooms; plug-in component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

# ---- group: Lbhb | Programme : Schedule, loads and setpoints / Lbhb_1 | Bedrooms with internal loads / Out_1 | Bedrooms with loads
sleeping_area_loads = Data(applyprogram_5.rooms)

# ---- group: Lbhb | Programme : Schedule, loads and setpoints / Lbhb_1 | Internal Loads Liv room / Out_1 | Liv Room with loads
liv_room_loads = Data(applyprogram_6.rooms)

# ---- group: Lbhb | Programme : Schedule, loads and setpoints / Lbhb_1 | Bathroom with internal loads / Out_1 | Bathroom with internal laods
bathroom_loads = Data(applyprogram_4.rooms)

# ----
entwine_4 = Entwine(
    Branch00=liv_room_loads,
    Branch01=kitchen_with_loads,
    Branch02=sleeping_area_loads,
    Branch03=unheated_spaces_loads,
    Branch04=bathroom_loads,
    Branch05=atticloads,
    FlattenInputs=True)

# ---- group: Out | Model with leads and schedule
# PEAK LOADS
seed_model_lds_sch = Data(flatten(entwine_4))

# ---- group: Uh | Calculating Heating Capcities for HT, MT and LT / Inp_1 | Seed model with loads and schedules
# 6a: Calculating heating capcities
# Heating capacities are calculated using DDY. These will be assumed to be what is requried for HT supply of heat.
# These heting capcities will be reduced to simulated MT and LT.
seed_model_lds_sch_2 = Data(graft(seed_model_lds_sch))

# ---- group: Lbhb | Applying heating capcities to spaces. / Inp_1 | Thermal zones with laods and schedules
seed_model_lds_sch_3 = Data(seed_model_lds_sch)

# ---- group: Uh | Calculating Heating Capcities for HT, MT and LT / Uh_2 | Custom componenets for calcualtign heating capcities for original HT supply.
geoprop_9 = HBGeometryProperties(rooms=flatten(seed_model_lds_sch_2))  # -> ext_wall_area, ext_win_area, volume, floor_area, floor_ep_constr; plug-in component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
bang_6 = ExplodeTree(Data=graft(geoprop_9.floor_ep_constr))  # -> Branch0, Branch1, Branch2, Branch3, Branch4, Branch5, Branch6, Branch7
bang_7 = ExplodeTree(Data=seed_model_lds_sch_2)  # -> Branch0, Branch1, Branch2, Branch3, Branch4, Branch5, Branch6, Branch7
bedrooms_vent_rate_m3_s_m2 = Data(division_2)
liv_vent_rate_m3_s_m2 = Data(division)
bed_s_gbo_m2 = Data(bang_6.Branch3)
bed_n_gbo_m2 = Data(bang_6.Branch2)
liv_room_gbo_m2 = Data(bang_6.Branch0)
multiplication = Multiplication(A=liv_vent_rate_m3_s_m2, B=liv_room_gbo_m2)
multiplication_2 = Multiplication(A=bedrooms_vent_rate_m3_s_m2, B=bed_s_gbo_m2)
multiplication_3 = Multiplication(A=bedrooms_vent_rate_m3_s_m2, B=bed_n_gbo_m2)
living_room_hb_zone = Data(bang_7.Branch0)
kitchen_vent_rate_m3_s = Data(division_12)
liv_vent_rate_m3_s = Data(multiplication)
kitchen_hb_zone = Data(bang_7.Branch1)
kitchen_gbo_m2 = Data(bang_6.Branch1)
bed_n_hb_zone = Data(bang_7.Branch2)
bed_n_vent_rate_m3_s = Data(multiplication_3)
bed_s_hb_zone = Data(bang_7.Branch3)
bed_s_vent_rate_m3_s = Data(multiplication_2)
heating_capacity_w = HeatingCapacityW(hb_model_of_zone=living_room_hb_zone, hb_zone_vent_flow_m3_s=liv_vent_rate_m3_s, gbo_hb_zone_m2=liv_room_gbo_m2)
heating_capacity_w_2 = HeatingCapacityW(hb_model_of_zone=kitchen_hb_zone, hb_zone_vent_flow_m3_s=kitchen_vent_rate_m3_s, gbo_hb_zone_m2=kitchen_gbo_m2)
heating_capacity_w_3 = HeatingCapacityW(hb_model_of_zone=bed_n_hb_zone, hb_zone_vent_flow_m3_s=bed_n_vent_rate_m3_s, gbo_hb_zone_m2=bed_n_gbo_m2)
heating_capacity_w_4 = HeatingCapacityW(hb_model_of_zone=bed_s_hb_zone, hb_zone_vent_flow_m3_s=bed_s_vent_rate_m3_s, gbo_hb_zone_m2=bed_s_gbo_m2)

# ---- group: Uh | Calculating Heating Capcities for HT, MT and LT / Inp_2 : Heating Capcity HT
kitchen_ht_capacity_w = Data(heating_capacity_w_2)
bed_n_ht_capacity_w = Data(heating_capacity_w_3)
living_room_ht_capacity_w = Data(heating_capacity_w)
bed_s_ht_capacity_w = Data(heating_capacity_w_4)

# ---- group: Uh | Calculating Heating Capcities for HT, MT and LT / Uh_2 | Simplifying tree structure
entwine_5 = Entwine(
    Branch00=living_room_ht_capacity_w,
    Branch01=kitchen_ht_capacity_w,
    Branch02=bed_n_ht_capacity_w,
    Branch03=bed_s_ht_capacity_w,
    FlattenInputs=True)
simplified_tree = Data(flatten(entwine_5))
ht_capacity = Data(simplified_tree)

# ---- group: Uh | Calculating Heating Capcities for HT, MT and LT / Uh_2 | MT and LT temperature calculations.
mt_capacity = GhPythonScript(HT_capacity=ht_capacity)  # -> MT_capacity
# ---------- mt_capacity: Python ----------
"""
This component redcues the heating capcity of the existing
HT capcity to MT (Medium Temperature) capcity. 
The equation is derived from :
    
D.S. Østergaard, S. Svendsen, Theoretical overview of heating power and necessary heating supply temperatures in typical Danish single-family houses from the 1900s, 
Energy Build. 126 (2016) 375–383. 
https://doi.org/10.1016/j.enbuild.2016.05.034.

    Args : 
        HT_capacity : Heating capcity calculated for High-temperature supply. 
        This is calculated as result of total heat losses. 
        
    Return : 
        MT_capacity : Reduced heating capcity due to Medium Temperature supply (70/50). 
"""

__author__ = "SID Drebbelweg"
__version__ = "2023.03.15"

import rhinoscriptsyntax as rs
import math

# TL : New temperature level for MT at 70/50
TL_sup = 70
TL_ret = 50

# Design indoor temperature 
Ti = 20

# Calculating logarithmic mean temperature difference. 
logmean_mt = (TL_sup - TL_ret)/math.log((TL_sup - Ti)/(TL_ret - Ti))

# TO : Original HT supply at 90/70
TO_sup = 90
TO_ret = 70

logmean_orig = (TO_sup - TO_ret)/math.log((TO_sup - Ti)/(TO_ret - Ti))

MT_capacity = ((logmean_mt/logmean_orig)**1.3)*HT_capacity
# ---------- end mt_capacity ----------
lt_capacity = GhPythonScript(HT_capacity=ht_capacity)  # -> LT_capacity
# ---------- lt_capacity: Python ----------
"""
This component redcues the heating capcity of the existing
HT capcity to LT (Low Temperature) capcity. 
The equation is derived from :
    
D.S. Østergaard, S. Svendsen, Theoretical overview of heating power and necessary heating supply temperatures in typical Danish single-family houses from the 1900s, 
Energy Build. 126 (2016) 375–383. 
https://doi.org/10.1016/j.enbuild.2016.05.034.

    Args : 
        HT_capacity : Heating capcity calculated for High-temperature supply. 
        This is calculated as result of total heat losses. 
        
    Return : 
        LT_capacity : Reduced heating capcity due to Medium Temperature supply (55/35). 
"""

__author__ = "SID Drebbelweg"
__version__ = "2023.03.15"

import rhinoscriptsyntax as rs
import math

# TL : New temperature level for MT at 70/50
TL_sup = 55
TL_ret = 35

# Design indoor temperature 
Ti = 20

# Calculating logarithmic mean temperature difference. 
logmean_lt = (TL_sup - TL_ret)/math.log((TL_sup - Ti)/(TL_ret - Ti))

# TO : Original HT supply at 90/70
TO_sup = 90
TO_ret = 70

logmean_orig = (TO_sup - TO_ret)/math.log((TO_sup - Ti)/(TO_ret - Ti))

LT_capacity = ((logmean_lt/logmean_orig)**1.3)*HT_capacity
# ---------- end lt_capacity ----------

# ---- group: Uh | Calculating Heating Capcities for HT, MT and LT
filter_4 = StreamFilter(Gate=temperature_level_2, Stream0=ht_capacity, Stream1=mt_capacity, Stream2=lt_capacity)

# ----
panel_13 = Panel(filter_4)

# ---- group: Out | Heating capcacities of zones.
heating_capacities_w = Data(filter_4)

# ---- group: Lbhb | Applying heating capcities to spaces. / Inp_1 | Heating capcacities for zones.
# 6b: Adding heating capacities to conditioned zones.
# Assigining the heating design capcities to the sapces.
heating_capacities_w_2 = Data(heating_capacities_w)

# ---- group: Lbhb | Applying heating capcities to spaces.
bang_8 = ExplodeTree(Data=graft(heating_capacities_w_2))  # -> Branch0, Branch1, Branch2, Branch3
bang_9 = ExplodeTree(Data=graft(seed_model_lds_sch_3))  # -> Branch0, Branch1, Branch2, Branch3, Branch4, Branch5, Branch6, Branch7
capacity_living_room = Data(bang_8.Branch0)
capacity_kitchen = Data(bang_8.Branch1)
capacity_bedroom_north = Data(bang_8.Branch2)
capacity_bedroom_south = Data(bang_8.Branch3)
zone_kitchen = Data(bang_9.Branch1)
zone_bedroom_north = Data(bang_9.Branch2)
zone_bedroom_south = Data(bang_9.Branch3)
zone_unheated_ff = Data(bang_9.Branch5)
zone_attic = Data(bang_9.Branch7)
zone_living_room = Data(bang_9.Branch0)
zone_unheated_gf = Data(bang_9.Branch4)
zone_bathroom = Data(bang_9.Branch6)
idealair = HBIdealAir(rooms=flatten(zone_living_room), economizer="NoEconomizer", heat_limit=capacity_living_room)  # -> report, rooms; plug-in component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
idealair_2 = HBIdealAir(rooms=flatten(zone_kitchen), economizer="NoEconomizer", heat_limit=capacity_kitchen)  # -> report, rooms; plug-in component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
idealair_3 = HBIdealAir(rooms=flatten(zone_bedroom_north), economizer="NoEconomizer", heat_limit=capacity_bedroom_north)  # -> report, rooms; plug-in component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
idealair_4 = HBIdealAir(rooms=flatten(zone_bedroom_south), economizer="NoEconomizer", heat_limit=capacity_bedroom_south)  # -> report, rooms; plug-in component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

# ---- group: Out | Model for simulation
final_dwelling_model = Data(flatten([idealair_2.rooms, idealair_3.rooms, idealair_4.rooms, zone_unheated_gf, zone_unheated_ff, zone_bathroom, zone_attic, idealair.rooms]))

# ---- group: Inp_1 | Final Model from Script
# Step 7 : Preparing HBjson to be send to pollination
final_dwelling_model_2 = Data(final_dwelling_model)

# ----
model = HBModel(rooms=flatten(final_dwelling_model_2))  # -> report, model; plug-in component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
dumpobjects = HBDumpObjects(hb_objs=flatten(model.model), name=concat_2, folder=hbjson_sub_dir_path, dump=toggle_8)  # -> report, hb_file; plug-in component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

# ---- group: Viz | Model visualisation / Inp_1 | Model for simulation
# 8: Visualising honeybee model
# Honeybee model visualisation using meshes
final_dwelling_model_3 = Data(final_dwelling_model)

# ---- group: Viz | Model visualisation
vizbytype = HBVisualizeByType(hb_objs=final_dwelling_model_3)  # -> walls, interior_walls, roofs, ceilings, exterior_floors, interior_floors, air_walls, apertures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; plug-in component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

# ---- group: Viz | Model visualisation / Out| connect for viz
viz_mesh = Mesh(vizbytype.walls)

# ---- group: Lbhb | Simulation / Inp_1 | Model for simulation
# 7: Honeybee Local simulations
# Simulation of models created for local machine
final_dwelling_model_4 = Data(final_dwelling_model)

# ---- group: Lbhb | Simulation
simoutput = HBSimulationOutput(zone_energy_use=toggle_16, comfort_metrics=toggle_16)  # -> report, sim_output; plug-in component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
model_2 = HBModel(rooms=flatten(final_dwelling_model_4), name="Terraced house")  # -> report, model; plug-in component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
panel_14 = Panel("""Zone Operative Temperature
Zone Air System Sensible Heating Rate""")
customoutput = HBCustomSimulationOutput(base_sim_output=simoutput.sim_output, output_names=panel_14)  # -> report, sim_output; plug-in component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
simpar = HBSimulationParameter(north=orientation_of_model, output=customoutput.sim_output, timestep=6)  # -> sim_par; plug-in component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
modeltoosm = HBModelToOSM(
    model=model_2.model,
    epw_file=nen_5060_epw,
    sim_par=simpar,
    folder=saving_sim_files,
    write=simulation_bool,
    run=simulation_bool)  # -> report, jsons, osw, osm, idf, sql, zsz, rdd, html; plug-in component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

# ---- group: inp_1 | Simpulation parameter for every hbjson
# Step 8 : Preparing sim_par files for every hbjson
sim_par = Data(simpar)

# ----
dumpobjects_2 = HBDumpObjects(hb_objs=flatten(sim_par), name=concat, folder=simpar_sub_dir_path, dump=toggle_8)  # -> report, hb_file; plug-in component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

# ---- group: Out | Thermal Comfort : Hours below 20% PPD as underheated hours. / Inp_1 | SQL from Simulation run
sql_simulations = Data(modeltoosm.sql)

# ---- group: Out | Space Heating Demand / Inp_1 | SQL from simulation run
# Simulation outputs.
# Space heating demand : House level [kWh/m2]
# Occupied cold hours below 20% PPD : Living room level [hours]
sql_simulations_2 = Data(modeltoosm.sql)

# ---- group: Out | Thermal Comfort : Hours below 20% PPD as underheated hours. / Uh_1 | Hops for reading SQL faster.
ot_hops_2 = Hops(
    _Enabled=read_results_hops_3,
    SQLPath=sql_simulations,
    TemperatureZoneName=zone_name_for_ot,
    CacheResultsInMemory=False,
    CacheSolveResults=False,
    RemoteDefinitionLocation="http://127.0.0.1:5000/temperature",
    RemoteSolveVersion=(0, 1, 0),
    ShowInput_Enabled=True,
    ShowInput_Path=False,
    SynchronousSolve=True)

# ---- group: Out | Space Heating Demand / Uh_1 | Hops for reading SQL faster.
heating_hops_2 = Hops(
    _Enabled=read_results_hops_4,
    SQLPath=sql_simulations_2,
    ZoneNames=conditioned_spaces,
    CacheResultsInMemory=False,
    CacheSolveResults=False,
    RemoteDefinitionLocation="http://127.0.0.1:5000/heating_kwh",
    RemoteSolveVersion=(0, 1, 0),
    ShowInput_Enabled=True,
    ShowInput_Path=False,
    SynchronousSolve=True)

# ---- group: Out | Thermal Comfort : Hours below 20% PPD as underheated hours. / Uh_1 | Reading json output from Hops
read_json_ot_2 = GhPythonScript(json_string=ot_hops_2)  # -> out, temperature_data; same code as read_json_ot

# ---- group: Out | Space Heating Demand / Uh_1 | extracting Heating demand and recording data
house_gbo_m2_2 = Data(gbo_m2)
division_15 = Division(A=heating_hops_2, B=house_gbo_m2_2)
rec_2 = DataRecorder(division_15, DataLimit=-10, RecordData=True)
null = NullItem(Item=rec_2)  # -> NullFlags, InvalidFlags, Description
cull = CullPattern(List=rec_2, CullPattern=invert(null.NullFlags))
shd_relay = Data(cull)

# ---- group: Out | Thermal Comfort : Hours below 20% PPD as underheated hours. / Uh_2 | Componenet to calculate comfort hours based on Peeters comfort model.
hours_below_20_ppd_2 = GhPythonScript(amot=xdata_3.values, indoor_optemp=read_json_ot_2.temperature_data, occ=xdata_4.values)  # -> means, running_mean, average_outdoortemp, neutral_temp, PPD_uplim, PPD_lowlim, htc, htw; inputs amot: list, indoor_optemp: list, occ: list; same code as hours_below_20_ppd
rec_3 = DataRecorder(hours_below_20_ppd_2.htc, DataLimit=-10, RecordData=True)
thermal_uncomfort = Data(flatten(rec_3))
larger = LargerThan(FirstNumber=thermal_uncomfort, SecondNumber="0")  # -> LargerThan, OrEqualTo
cull_2 = CullPattern(List=thermal_uncomfort, CullPattern=larger.LargerThan)

# ---- group: Out | Output quick read
space_heating_demand = Panel(shd_relay)
_20_ppd_lowerlimit = Panel(cull_2)

# ----
panel_15 = Panel(modeltoosm.jsons)
thermal_uncomfort_2 = Data(flatten(hours_below_20_ppd_2.htc))
larger_2 = LargerThan(FirstNumber=thermal_uncomfort_2, SecondNumber="0")  # -> LargerThan, OrEqualTo
cull_3 = CullPattern(List=thermal_uncomfort_2, CullPattern=larger_2.LargerThan)

# ---- group: Out | Space Heating Demand / Inp_1 | SQL from simulation run
# 7b_alt: Simulation Outputs_native
# Simulation outputs.
# Space heating demand : House level [kWh/m2]
# Occupied cold hours below 20% PPD : Living room level [hours]
sql_simulations_3 = Data(modeltoosm.sql)

# ---- group: Out | Thermal Comfort : Hours below 20% PPD as underheated hours. / Inp_1 | SQL from Simulation run
sql_simulations_4 = Data(modeltoosm.sql)

# ---- group: Out | Space Heating Demand
roomenergyresult = HBReadRoomEnergyResult(sql=sql_simulations_3)  # -> cooling, heating, lighting, electric_equip, gas_equip, process, hot_water, fan_electric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; plug-in component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

# ---- group: Out | Thermal Comfort : Hours below 20% PPD as underheated hours. / Lbhb_2 | Reading Living room indoor OT
roomcomfortresult = HBReadRoomComfortResult(sql=sql_simulations_4)  # -> oper_temp, air_temp, rad_temp, rel_humidity; plug-in component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
item_4 = ListItem(List=roomcomfortresult.oper_temp, Index=Slider(4, range=0..7), Wrap=True)
xdata_7 = LBDeconstructData(data=item_4)  # -> header, values; plug-in component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

# ---- group: Out | Space Heating Demand / Uh_1 | extracting Heating demand and recording data
xdata_8 = LBDeconstructData(data=roomenergyresult.heating)  # -> header, values; plug-in component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
ma_10 = MassAddition(Input=flatten(xdata_8.values))  # -> Result, PartialResults
house_gbo_m2_3 = Data(gbo_m2)
division_16 = Division(A=ma_10.Result, B=house_gbo_m2_3)
rec_4 = DataRecorder(division_16, DataLimit=-10, RecordData=True)
null_2 = NullItem(Item=rec_4)  # -> NullFlags, InvalidFlags, Description
cull_4 = CullPattern(List=rec_4, CullPattern=invert(null_2.NullFlags))
shd_relay_2 = Data(cull_4)

# ---- group: Out | Thermal Comfort : Hours below 20% PPD as underheated hours. / Uh_2 | Componenet to calculate comfort hours based on Peeters comfort model.
hours_below_20_ppd_3 = GhPythonScript(amot=xdata_6.values, indoor_optemp=xdata_7.values, occ=xdata_5.values)  # -> means, running_mean, average_outdoortemp, neutral_temp, PPD_uplim, PPD_lowlim, htc, htw; inputs amot: list, indoor_optemp: list, occ: list; same code as hours_below_20_ppd
rec_5 = DataRecorder(hours_below_20_ppd_3.htc, DataLimit=-10, RecordData=True)
thermal_uncomfort_3 = Data(flatten(rec_5))
larger_3 = LargerThan(FirstNumber=thermal_uncomfort_3, SecondNumber="0")  # -> LargerThan, OrEqualTo
cull_5 = CullPattern(List=thermal_uncomfort_3, CullPattern=larger_3.LargerThan)

# ----
sh_demand_kwh_m2_2 = Panel(shd_relay_2)
occupied_cold_hours_hours = Panel(cull_5)

# ==== cluster HeatingCapacityW
hb_zone_vent_flow_m3_s = ClusterInput()  # Ventilation flow in m3/s calculate for the one.
gbo_hb_zone_m2 = ClusterInput()
hb_model_of_zone = ClusterInput()  # HB Model of the seprate zone for which heating capcity is to be calculated.
nen5060_epw_minus10ddy = FilePath("C:\Users\prateekwahi\OneDrive - Delft University of Technology\PhD\7. Reports\3. Papers\3. paper 3\simulations\6.Terraced houses\4. Weather Files\Simulation files used\ddyminus10\NEN5060_min10_Hddy.ddy")
nen5060_epw = FilePath("C:\Users\prateekwahi\OneDrive - Delft University of Technology\PhD\7. Reports\3. Papers\3. paper 3\simulations\6.Terraced houses\4. Weather Files\Simulation files used\NEN5060_2018_Hddy.ddy")
toggle = BooleanToggle(True)
peakloads = HBPeakLoads(rooms=hb_model_of_zone, ddy_file=nen5060_epw_minus10ddy, run_bal=toggle, run=toggle)  # -> report, peak_cool, peak_heat, cooling, heating, cool_bal, heat_bal; plug-in component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
xdata = LBDeconstructData(data=peakloads.heat_bal)  # -> header, values; plug-in component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
bnd = Bounds(Numbers=xdata.values)
dedomain = DeconstructDomain(Domain=flatten(bnd))  # -> Start, End
index_for_window_opaque_and_infilteratio = Panel("""1
2
3""")  # "Index for window, opaque and infilteration"
design_inside = Panel("20")
vent_rate_m3_s = Data(hb_zone_vent_flow_m3_s)
design_outside = Panel("-10")
item = ListItem(List=dedomain.End, Index=index_for_window_opaque_and_infilteratio, Wrap=True)
expression = Expression(Tin=design_inside, Tout=design_outside, qv=vent_rate_m3_s, Expression="(Tin - Tout)*1200*qv")
heat_loss_due_to_transparent_opqaue_and = Panel(item)  # "Heat loss due to transparent, opqaue and infilteration [W]"
ma = MassAddition(Input=item)  # -> Result, PartialResults

# ---- group: heat loss due to heating
# Source:
# https://klimapedia.nl/wp-content/uploads/2013/05/I-490-Afgifte-verwarming-globale-handberekeningen-v0.pdf
panel = Panel("20")
multiplication = Multiplication(A=gbo_hb_zone_m2, B=panel)

# ----
panel_2 = Panel("0")
heat_loss_trans_infil_w = Panel(ma.Result)
ma_2 = MassAddition(Input=ma.Result)  # -> Result, PartialResults
# Heating Capacity = heat loss due to (transmission + ventilaiton + heating the sapce itself)
expression_2 = Expression(
    ventloss=expression,
    tranloss=ma_2.Result,
    heatingloss=multiplication,
    Expression="ventloss + (tranloss*-1) + heatingloss")
gbo_liv = Data(gbo_hb_zone_m2)
division = Division(A=expression_2, B=gbo_liv)
hb_zone_heat_cap_w = ClusterOutput(expression_2)
